# Grasshopper definition FireAnt.gh (Grasshopper 0.9.76)
# plug-ins: Python Interpreter

panel = Panel("REDUCED CROSS SECTION")
pt = ConstructPoint(XCoordinate=0, YCoordinate=0, ZCoordinate=0)
pt_2 = ConstructPoint(XCoordinate=0, YCoordinate=0, ZCoordinate=Slider(4000, range=0..10000))
pt_3 = ConstructPoint(XCoordinate=0, YCoordinate=Slider(3801, range=0..10000), ZCoordinate=0)
pt_4 = ConstructPoint(XCoordinate=0, YCoordinate=0, ZCoordinate=0)
ln = Line(StartPoint=pt, EndPoint=pt_2)
ln_2 = Line(StartPoint=pt_4, EndPoint=pt_3)
time_of_exposure = Slider(60, range=0..120)
time_of_exposure_2 = Slider(31, range=0..120)
crv = Curve(ln)
crv_2 = Curve(ln_2)
column_stdfire_rcs = PythonScript(
    CL=crv,
    F=Slider(32000, range=0..1000000),
    Str="c24",
    Sup=Slider(1, range=0..10),
    ToW="sawn",
    WidthProfile=Slider(0, range=0..1000),
    HeightProfile=Slider(0, range=0..1000),
    WS=Slider(1, range=0..10),
    t=time_of_exposure,
    SEF=Slider(1, range=1..8))  # -> ErrorMessage, Utilization, NRcfire, Width, Height, Geo; inputs CL: Curve
# ---------- column_stdfire_rcs: Python ----------
"""
Column - Standard fire with reduced cross section method

    Args:
        CL: Center Line for column
        F: Vertical load,N, for the column to support (Calculated as a centrally placed load, also in the case when the column's center of gravity moves)
        Str: Strength class for the wood (C30, C24, C18, C14, GL32h, GL28h or GL24h)[Default: 24C]
        Sup: Support conditions for the column (1=Simply supported both ends, 2=One end fixed and one end not supported, 3=One end fixed and one end simply supported, 4=Both ends fixed [Default: Simply supported]
        ToW: Type of Wood; Sawn, Planed or Glulam (Glued laminated timber) standard profiles [Default: sawn]
        WidthProfile: Width of profile [mm] to calculate NRc,fire for. If no value is inserted, the NRc,fire is calculated based on ToW.
        HeightProfile: Height of profile [mm] to calculate NRc,fire for. If no value is inserted, the NRc,fire is calculated based on ToW.
        WS: Wood Species (1=Conifer p>290 kg/m3, 2=Laminated wood p>290 kg/m3 , 3=Hardwood p>450 kg/m3 [Default: Conifer]
        t: Time of exposure in minutes [Default 60]
        SEF: Sides Exposed to Fire(1=Width, 2=Height, 3=Width+Height, 4=Width+2*Height, 5=2*Width+Height, 6=2*Width, 7=2*Height, 8=All [Default: All]
    Returns:
        NRc,fire: Charateristic resistance of the column after fire [kN]
        Width: Width of the cross section before fire [mm]
        Height: Height of the cross section before fire [mm]
        Geo: 3D model of the cross section
        Utilization: Utilization rate [%]
        ErrorMessage: Check this output for error messages

"""

import rhinoscriptsyntax as rs
import math as m

"""-------------------------------------------------------------------------"""
# USER INPUTS
# Defaults
StrDef = 'c24'
SupDef = 1
ToWDef = 'sawn'
WSDef = 1
tDef = 60
SEFDef = 8

if not Str:
    Str=StrDef
if not Sup:
    Sup=SupDef
if not ToW:
    ToW=ToWDef
if not WS:
    WS=WSDef
if not t:
    t=tDef
if not SEF:
    SEF=SEFDef

# Support conditions
if Sup==1:
    l0=1
elif Sup==2:
    l0=2
elif Sup==3:
    l0=0.699
elif Sup==4:
    l0=1/2
else:
    l0=1

# Strength class
if str.upper(Str)=='C30':
    fm=30
    fc=23
    E=8000
elif str.upper(Str)=='C24':
    fm=24
    fc=21
    E=7400
elif str.upper(Str)=='C18':
    fm=18
    fc=18
    E=6000
elif str.upper(Str)=='C14':
    fm=14
    fc=16
    E=4700
elif str.upper(Str)=='GL32H':
    fm=32
    fc=29
    E=11100
elif str.upper(Str)=='GL28H':
    fm=38
    fc=26.5
    E=10200
elif str.upper(Str)=='GL24H':
    fm=24
    fc=24
    E=9400

if WidthProfile>0 and HeightProfile>0:
    W=[WidthProfile]
    H=[HeightProfile]
    Bc=0.1
    Input=0
elif str.lower(ToW)=='sawn':
    W=[50,38,50,50,75,50,50,63,50,50,100,50,75,75,75,125,75,100,150,100,175,200]
    H=[50,73,75,100,75,125,150,125,175,200,100,225,150,175,200,125,225,200,150,225,175,200]
    Bc=0.2
    Input=1
elif str.lower(ToW)=='planed':
    W=[45,45,45,70,45,45,45,45,95,45,70,70,70,120,70,95,145,95,170,195]
    H=[45,70,95,70,120,145,170,195,95,220,145,170,195,120,220,195,145,220,170,195]
    Bc=0.2
    Input=1
elif str.lower(ToW)=='glulam':
    w=[185,160,140,115,90,65,185,160,140,115,90,65,185,160,140,115,90,65,
    185,160,140,115,90,65,185,160,140,115,90,65,185,160,140,115,90,65,
    185,160,140,115,90,65,185,160,140,115,90,65,185,160,140,115,90,65,
    185,160,140,115,90,65,185,160,140,115,90,65,185,160,140,115,90,65,
    185,160,140,115,90,65,185,160,140,115,90,65,185,160,140,115,90,65,
    185,160,140,115,90,65,185,160,140,115,90,65,185,160,140,115,90,65,
    185,160,140,115,90,65,185,160,140,115,90,65,185,160,140,115,90,65,
    185,160,140,115,90,65,185,160,140,115,90,65,185,160,140,115,90,65,
    185,160,140,115,90,65,185,160,140,115,90,65,185,160,140,115,90,65,
    185,160,140,115,90,65,185,160,140,115,90,65,185,160,140,115,90,65,
    185,160,140,115,90,65,185,160,140,115,90,65,185,160,140,115,90,65,
    185,160,140,115,90,65,185,160,140,115,90,65,185,160,140,115,90,65,
    185,160,140,115,90,65,185,160,140,115,90,65,185,160,140,115,90,65,
    185,160,140,115,90,65,185,160,140,115,90,65,185,160,140,115,90,65,
    185,160,140,115,90,65]
    h=[100,100,100,100,100,100,133,133,133,133,133,133,167,167,167,167,167,167,
    200,200,200,200,200,200,233,233,233,233,233,233,267,267,267,267,267,267,
    300,300,300,300,300,300,333,333,333,333,333,333,367,367,367,367,367,367,
    400,400,400,400,400,400,433,433,433,433,433,433,467,467,467,467,467,467,
    500,500,500,500,500,500,533,533,533,533,533,533,567,567,567,567,567,567,
    600,600,600,600,600,600,633,633,633,633,633,633,667,667,667,667,667,667,
    700,700,700,700,700,700,733,733,733,733,733,733,767,767,767,767,767,767,
    800,800,800,800,800,800,833,833,833,833,833,833,867,867,867,867,867,867,
    900,900,900,900,900,900,933,933,933,933,933,933,967,967,967,967,967,967,
    1000,1000,1000,1000,1000,1000,1033,1033,1033,1033,1033,1033,1067,1067,1067,1067,1067,1067,
    1100,1100,1100,1100,1100,1100,1133,1133,1133,1133,1133,1133,1167,1167,1167,1167,1167,1167,
    1200,1200,1200,1200,1200,1200,1233,1233,1233,1233,1233,1233,1267,1267,1267,1267,1267,1267,
    1300,1300,1300,1300,1300,1300,1333,1333,1333,1333,1333,1333,1367,1367,1367,1367,1367,1367,
    1400,1400,1400,1400,1400,1400,1433,1433,1433,1433,1433,1433,1467,1467,1467,1467,1467,1467,
    1500,1500,1500,1500,1500,1500]
    A=[]
    for i in range(len(w)):
        A.append(w[i]*h[i]) 
    W = [x for _,x in sorted(zip(A,w))]
    H = [x for _,x in sorted(zip(A,h))]
    Bc=0.1
    Input=1

#Wood species
if WS==1:
    Bn=0.8
elif WS==2:
    Bn=0.7
elif WS==3:
    Bn=0.55
else:
    Bn=0.8

#Sides exposed to fire
SEF = m.ceil(SEF)
if SEF>8:
    SEF=8

"""-------------------------------------------------------------------------"""
# CALCULATION OF CROSS SECTION AFTER FIRE
#Pyrolysis Zone
if t<20: 
    dpy = 7/20*t 
else:
    dpy = 7
# Charring layer
dchar = Bn*t+dpy

# Cross section after fire
w = [] 
h = []
for i in range(len(W)):
    if SEF==1:
        w.append(W[i])
        h.append(H[i]-dchar)
    elif SEF==2:
        w.append(W[i]-dchar)
        h.append(H[i])
    elif SEF==3:
        w.append(W[i]-dchar)
        h.append(H[i]-dchar)
    elif SEF==4:
        w.append(W[i]-2*dchar)
        h.append(H[i]-dchar)
    elif SEF==5:
        w.append(W[i]-dchar)
        h.append(H[i]-2*dchar)
    elif SEF==6:
        w.append(W[i])
        h.append(H[i]-2*dchar)
    elif SEF==7:
        w.append(W[i]-2*dchar)
        h.append(H[i])
    elif SEF==8:
        w.append(W[i]-2*dchar)
        h.append(H[i]-2*dchar)

wr = [] 
hr = []
Wr = []
Hr = []
Ar = []
for i in range(len(w)):
    if w[i]>0 and h[i]>0:
        wr.append(w[i])
        hr.append(h[i])
        Wr.append(W[i])
        Hr.append(H[i])
        # Area of cross section
        Ar.append(w[i]*h[i])

"""-------------------------------------------------------------------------"""
# Calculation of new moment of inertia
Iy = []
Iz = []
for i in range(len(wr)):
    Iy.append(1/12*wr[i]*hr[i]**3)
    Iz.append(1/12*hr[i]*wr[i]**3)
"""-------------------------------------------------------------------------"""

# Verification of wooden column (Calculation of NRc,fire)
# Critical buckling length
ls = rs.CurveLength(CL)

# Checking for weakest axis
I = []
for i in range(len(wr)):
    if hr[i]>wr[i]:
        I.append(Iz[i])
    else:
        I.append(Iy[i])

Lambda = []
SigmaE = []  
kE = []  
Lambdarel = [] 
kfire = []
kc = []
Nrcfire = []

for i in range(len(wr)):
    #Slenderness ratio
    Lambda.append(ls/m.sqrt(I[i]/Ar[i]))
    #Euler stress
    SigmaE.append(m.pi**2*(E/fc))
    #Euler factor
    kE.append(SigmaE[i]/fc)
    #Relative slenderness ratio
    Lambdarel.append(Lambda[i]/m.sqrt(SigmaE[i]))
    #kfire coefficient
    kfire.append(0.5*(1+Bc*(Lambdarel[i]-0.5)+Lambdarel[i]**2))
    #Critical buckling factor
    if Lambdarel[i]<0.5:
        kc.append(1.0)
    else:
        kc.append(1/(kfire[i]+m.sqrt(kfire[i]**2-Lambdarel[i]**2)))
    #Characteristic resistance of wood
    Nrcfire.append(Ar[i]*fc*kc[i])

if Input==0:
    if Nrcfire>F:
        Width = WidthProfile
        Height = HeightProfile
        NRcfire = Nrcfire
        Utilization = F/NRcfire[0]
    else:
        ErrorMessage='No profiles with selected citeria can support the load'

else:
# Selecting the smallest profile with capability to support the load
    Wi = []
    He = []
    NRc =[]
    for i in range(len(wr)):
        if Nrcfire[i]>F:
            Wi.append(Wr[i])
            He.append(Hr[i])
            NRc.append(Nrcfire[i])
    if len(Wi)>0:
        Width = Wi[0]
        Height = He[0]
        NRcfire = NRc[0]
        Utilization = F/NRcfire
    else:
        ErrorMessage='No profiles with selected citeria can support the load'


"""-------------------------------------------------------------------------"""
# 3D model for "baking"
if NRcfire>F:
    End = rs.CurveEndPoint(CL)
    Start = rs.CurveStartPoint(CL)
    Vector = rs.VectorAdd(Start,End)
    Plane = rs.PlaneFromNormal(Start,Vector)
    CrossSection = rs.AddRectangle(Plane, Width, Height)
    #Translation vector center
    Vec1 =rs.VectorAdd([0,0,0],[-Width/2,-Height/2,0])
    Geo = rs.MoveObject(rs.ExtrudeCurve(CrossSection,CL),Vec1)
    rs.CapPlanarHoles(Geo)
# ---------- end column_stdfire_rcs ----------
beam_stdfire_rcs = PythonScript(
    CL=crv_2,
    F=Slider(5, range=0..10),
    Str="c24",
    Sup=Slider(1, range=0..10),
    ToW="sawn",
    WidthProfile=Slider(100, range=0..100),
    HeightProfile=Slider(225, range=0..1000),
    WS=Slider(1, range=0..10),
    t=time_of_exposure_2,
    SEF=Slider(1, range=0..10))  # -> ErrorMessage, Utilization, Sigmafire, Width, Height, Geo; inputs CL: Curve
#   port Sigmafire: Flexural stress [MPa)
# ---------- beam_stdfire_rcs: Python ----------
"""
Beam - Standard fire with reduced cross section method

    Args:
        CL: Center Line for column
        F: Vertical load,N, for the column to support (Calculated as a centrally placed load, also in the case when the column's center of gravity moves)
        Str: Strength class for the wood (C30, C24, C18, C14, GL32h, GL28h or GL24h)[Default: 24C]
        Sup: Support conditions for the column (1=Simply supported both ends, 2=One end fixed and one end not supported, 3=One end fixed and one end simply supported, 4=Both ends fixed [Default: Simply supported]
        ToW: Type of Wood; Sawn, Planed or Glulam (Glued laminated timber) standard profiles [Default: sawn]
        WidthProfile: Width of profile [mm] to calculate NRc,fire for. If no value is inserted, the NRc,fire is calculated based on ToW.
        HeightProfile: Height of profile [mm] to calculate NRc,fire for. If no value is inserted, the NRc,fire is calculated based on ToW.
        WS: Wood Species (1=Conifer p>290 kg/m3, 2=Laminated wood p>290 kg/m3 , 3=Hardwood p>450 kg/m3 [Default: Conifer]
        t: Time of exposure in minutes [Default 60]
        SEF: Sides Exposed to Fire(1=Width, 2=Height, 3=Width+Height, 4=Width+2*Height, 5=2*Width+Height, 6=2*Width, 7=2*Height, 8=All [Default: Width+2*Height]
    Returns:
        NRc,fire: Charateristic resistance of the column after fire [kN]
        Width: Width of the cross section before fire [mm]
        Height: Height of the cross section before fire [mm]
        Geo: 3D model of the cross section
        Utilization: Utilization rate [%]
        ErrorMessage: Check this output for error messages
"""

import rhinoscriptsyntax as rs
import math as m

"""-------------------------------------------------------------------------"""
# USER INPUTS
StrDef = 'c24'
SupDef = 1
ToWDef = 'sawn'
WSDef = 1
tDef = 60
SEFDef = 4

if not Str:
    Str=StrDef
if not Sup:
    Sup=SupDef
if not ToW:
    ToW=ToWDef
if not WS:
    WS=WSDef
if not t:
    t=tDef
if not SEF:
    SEF=SEFDef
# Support conditions
L=rs.CurveLength(CL)
if Sup==1:
    Mmax=1/8*F*L**2
elif Sup==2:
    Mmax=1/2*F*L**2
elif Sup==3:
    Mmax=9/128*F*L**2
elif Sup==4:
    Mmax=1/8*F*L**2


# Strength class
if str.upper(Str)=='C30':
    fm=30
    fc=23
    E=8000
elif str.upper(Str)=='C24':
    fm=24
    fc=21
    E=7400
elif str.upper(Str)=='C18':
    fm=18
    fc=18
    E=6000
elif str.upper(Str)=='C14':
    fm=14
    fc=16
    E=4700
elif str.upper(Str)=='GL32H':
    fm=32
    fc=29
    E=11100
elif str.upper(Str)=='GL28H':
    fm=38
    fc=26.5
    E=10200
elif str.upper(Str)=='GL24H':
    fm=24
    fc=24
    E=9400

if WidthProfile>0 and HeightProfile>0:
    W=[WidthProfile]
    H=[HeightProfile]
    Input=0
elif str.lower(ToW)=='sawn':
    W=[50,38,50,50,75,50,50,63,50,50,100,50,75,75,75,125,75,100,150,100,175,200]
    H=[50,73,75,100,75,125,150,125,175,200,100,225,150,175,200,125,225,200,150,225,175,200]
    Input=1
elif str.lower(ToW)=='planed':
    W=[45,45,45,70,45,45,45,45,95,45,70,70,70,120,70,95,145,95,170,195]
    H=[45,70,95,70,120,145,170,195,95,220,145,170,195,120,220,195,145,220,170,195]
    Input=1
elif str.lower(ToW)=='glulam':
    w=[185,160,140,115,90,65,185,160,140,115,90,65,185,160,140,115,90,65,
    185,160,140,115,90,65,185,160,140,115,90,65,185,160,140,115,90,65,
    185,160,140,115,90,65,185,160,140,115,90,65,185,160,140,115,90,65,
    185,160,140,115,90,65,185,160,140,115,90,65,185,160,140,115,90,65,
    185,160,140,115,90,65,185,160,140,115,90,65,185,160,140,115,90,65,
    185,160,140,115,90,65,185,160,140,115,90,65,185,160,140,115,90,65,
    185,160,140,115,90,65,185,160,140,115,90,65,185,160,140,115,90,65,
    185,160,140,115,90,65,185,160,140,115,90,65,185,160,140,115,90,65,
    185,160,140,115,90,65,185,160,140,115,90,65,185,160,140,115,90,65,
    185,160,140,115,90,65,185,160,140,115,90,65,185,160,140,115,90,65,
    185,160,140,115,90,65,185,160,140,115,90,65,185,160,140,115,90,65,
    185,160,140,115,90,65,185,160,140,115,90,65,185,160,140,115,90,65,
    185,160,140,115,90,65,185,160,140,115,90,65,185,160,140,115,90,65,
    185,160,140,115,90,65,185,160,140,115,90,65,185,160,140,115,90,65,
    185,160,140,115,90,65]
    h=[100,100,100,100,100,100,133,133,133,133,133,133,167,167,167,167,167,167,
    200,200,200,200,200,200,233,233,233,233,233,233,267,267,267,267,267,267,
    300,300,300,300,300,300,333,333,333,333,333,333,367,367,367,367,367,367,
    400,400,400,400,400,400,433,433,433,433,433,433,467,467,467,467,467,467,
    500,500,500,500,500,500,533,533,533,533,533,533,567,567,567,567,567,567,
    600,600,600,600,600,600,633,633,633,633,633,633,667,667,667,667,667,667,
    700,700,700,700,700,700,733,733,733,733,733,733,767,767,767,767,767,767,
    800,800,800,800,800,800,833,833,833,833,833,833,867,867,867,867,867,867,
    900,900,900,900,900,900,933,933,933,933,933,933,967,967,967,967,967,967,
    1000,1000,1000,1000,1000,1000,1033,1033,1033,1033,1033,1033,1067,1067,1067,1067,1067,1067,
    1100,1100,1100,1100,1100,1100,1133,1133,1133,1133,1133,1133,1167,1167,1167,1167,1167,1167,
    1200,1200,1200,1200,1200,1200,1233,1233,1233,1233,1233,1233,1267,1267,1267,1267,1267,1267,
    1300,1300,1300,1300,1300,1300,1333,1333,1333,1333,1333,1333,1367,1367,1367,1367,1367,1367,
    1400,1400,1400,1400,1400,1400,1433,1433,1433,1433,1433,1433,1467,1467,1467,1467,1467,1467,
    1500,1500,1500,1500,1500,1500]
    A=[]
    for i in range(len(w)):
        A.append(w[i]*h[i]) 
    W = [x for _,x in sorted(zip(A,w))]
    H = [x for _,x in sorted(zip(A,h))]
    Bc=0.1
    Input=1

#Wood species
if WS==1:
    Bn=0.8
elif WS==2:
    Bn=0.7
elif WS==3:
    Bn=0.55
else:
    Bn=0.8

#Sides exposed to fire
SEF = m.ceil(SEF)
if SEF>8:
    SEF=8

"""-------------------------------------------------------------------------"""
# CALCULATION OF CROSS SECTION AFTER FIRE
#Pyrolysis Zone
if t<20: 
    dpy = 7/20*t 
else:
    dpy = 7
# Charring layer
dchar = Bn*t+dpy

# Cross section after fire
w = [] 
h = []
for i in range(len(W)):
    if SEF==1:
        w.append(W[i])
        h.append(H[i]-dchar)
    elif SEF==2:
        w.append(W[i]-dchar)
        h.append(H[i])
    elif SEF==3:
        w.append(W[i]-dchar)
        h.append(H[i]-dchar)
    elif SEF==4:
        w.append(W[i]-2*dchar)
        h.append(H[i]-dchar)
    elif SEF==5:
        w.append(W[i]-dchar)
        h.append(H[i]-2*dchar)
    elif SEF==6:
        w.append(W[i])
        h.append(H[i]-2*dchar)
    elif SEF==7:
        w.append(W[i]-2*dchar)
        h.append(H[i])
    elif SEF==8:
        w.append(W[i]-2*dchar)
        h.append(H[i]-2*dchar)

wr = [] 
hr = []
Wr = []
Hr = []
Ar = []
for i in range(len(w)):
    if w[i]>0 and h[i]>0:
        wr.append(w[i])
        hr.append(h[i])
        Wr.append(W[i])
        Hr.append(H[i])
        # Area of cross section
        Ar.append(w[i]*h[i])


"""-------------------------------------------------------------------------"""
# Calculation of new moment of inertia
Iy = []
Iz = []
for i in range(len(wr)):
    Iy.append(1/12*wr[i]*hr[i]**3)
    Iz.append(1/12*hr[i]*wr[i]**3)

"""-------------------------------------------------------------------------"""

# Verification of wooden beam 
sigmafire = []
for i in range(len(Wr)):
    sigmafire.append(Mmax/Iy[i]*Hr[i]/2)

if Input==0:
    if 0<sigmafire[i]<fm:
       Width = WidthProfile
       Height = HeightProfile
       Sigmafire = sigmafire[0]
       Utilization = Sigmafire/fm*100
    else:
        ErrorMessage='No profiles with selected citeria can support the load'
else:
    # Selecting the smallest profile with capability to support the load
    Wi = []
    He = []
    fmfire =[]
    for i in range(len(wr)):
        if 0<sigmafire[i]<fm:
            Wi.append(Wr[i])
            He.append(Hr[i])
            fmfire.append(sigmafire[i])
    if len(Wi)>0:
        Width = Wi[0]
        Height = He[0]
        Sigmafire = fmfire[0]
        Utilization = Sigmafire/fm*100
    else:
        ErrorMessage='No profiles with selected citeria can support the load'



"""-------------------------------------------------------------------------"""
# 3D model for "baking"
if Sigmafire>fm:
    End = rs.CurveEndPoint(CL)
    Start = rs.CurveStartPoint(CL)
    Vector = rs.VectorAdd(Start,End)
    Plane = rs.PlaneFromNormal(Start,Vector)
    CrossSection = rs.AddRectangle(Plane, Height, Width)
    #Translation vector center
    Vec1 =rs.VectorAdd([0,0,0],[-Width/2,0,-Height/2])
    Geo = rs.MoveObject(rs.ExtrudeCurve(CrossSection,CL),Vec1)
    rs.CapPlanarHoles(Geo)
# ---------- end beam_stdfire_rcs ----------
panel_2 = Panel(column_stdfire_rcs.Utilization)
panel_3 = Panel(column_stdfire_rcs.NRcfire)
panel_4 = Panel(column_stdfire_rcs.Width)
panel_5 = Panel(column_stdfire_rcs.Height)
panel_6 = Panel(beam_stdfire_rcs.Height)
panel_7 = Panel(beam_stdfire_rcs.Utilization)
panel_8 = Panel(beam_stdfire_rcs.Width)

pt_5 = ConstructPoint(XCoordinate=0, YCoordinate=0, ZCoordinate=0)
panel_9 = Panel("STRENGTH REDUCTION ")
pt_6 = ConstructPoint(XCoordinate=0, YCoordinate=0, ZCoordinate=Slider(4000, range=0..10000))
pt_7 = ConstructPoint(XCoordinate=0, YCoordinate=0, ZCoordinate=0)
pt_8 = ConstructPoint(XCoordinate=0, YCoordinate=Slider(4000, range=0..10000), ZCoordinate=0)
ln_3 = Line(StartPoint=pt_5, EndPoint=pt_6)
ln_4 = Line(StartPoint=pt_7, EndPoint=pt_8)
time_of_exposure_3 = Slider(60, range=0..120)
time_of_exposure_4 = Slider(77, range=0..120)
crv_3 = Curve(ln_3)
crv_4 = Curve(ln_4)
beam_stdfire_sr = PythonScript(
    CL=crv_4,
    F=Slider(6, range=0..100),
    Str="c24",
    Sup=Slider(1, range=0..10),
    ToW="sawn",
    WidthProfile=Slider(0, range=0..100),
    HeightProfile=Slider(0, range=0..1000),
    WS=Slider(1, range=0..10),
    t=time_of_exposure_4,
    SEF=Slider(1, range=0..10))  # -> ErrorMessage, Utilization, Sigmafire, Width, Height, Geo; inputs CL: Curve
#   port Sigmafire: Flexural stress [MPa)
# ---------- beam_stdfire_sr: Python ----------
"""
Beam - Standard fire with strength reduction method

    Args:
        CL: Center Line for column
        F: Vertical load,N, for the column to support (Calculated as a centrally placed load, also in the case when the column's center of gravity moves)
        Str: Strength class for the wood (C30, C24, C18, C14, GL32h, GL28h or GL24h)[Default: 24C]
        Sup: Support conditions for the column (1=Simply supported both ends, 2=One end fixed and one end not supported, 3=One end fixed and one end simply supported, 4=Both ends fixed [Default: Simply supported]
        ToW: Type of Wood; Sawn, Planed or Glulam (Glued laminated timber) standard profiles [Default: sawn]
        WidthProfile: Width of profile [mm] to calculate NRc,fire for. If no value is inserted, the NRc,fire is calculated based on ToW.
        HeightProfile: Height of profile [mm] to calculate NRc,fire for. If no value is inserted, the NRc,fire is calculated based on ToW.
        WS: Wood Species (1=Conifer p>290 kg/m3, 2=Laminated wood p>290 kg/m3 , 3=Hardwood p>450 kg/m3 [Default: Conifer]
        t: Time of exposure in minutes [Default 60]
        SEF: Sides Exposed to Fire(1=Width, 2=Height, 3=Width+Height, 4=Width+2*Height, 5=2*Width+Height, 6=2*Width, 7=2*Height, 8=All [Default: Width+2*Height]
    Returns:
        NRc,fire: Charateristic resistance of the column after fire [kN]
        Width: Width of the cross section before fire [mm]
        Height: Height of the cross section before fire [mm]
        Geo: 3D model of the cross section
        Utilization: Utilization rate [%]
        ErrorMessage: Check this output for error messages
"""

import rhinoscriptsyntax as rs
import math as m

"""-------------------------------------------------------------------------"""
# USER INPUTS
StrDef = 'c24'
SupDef = 1
ToWDef = 'sawn'
WSDef = 1
tDef = 60
SEFDef = 4

if not Str:
    Str=StrDef
if not Sup:
    Sup=SupDef
if not ToW:
    ToW=ToWDef
if not WS:
    WS=WSDef
if not t:
    t=tDef
if not SEF:
    SEF=SEFDef
# Support conditions
L=rs.CurveLength(CL)
if Sup==1:
    Mmax=1/8*F*L**2
elif Sup==2:
    Mmax=1/2*F*L**2
elif Sup==3:
    Mmax=9/128*F*L**2
elif Sup==4:
    Mmax=1/8*F*L**2


# Strength class
if str.upper(Str)=='C30':
    fm=30
    fc=23
    E=8000
elif str.upper(Str)=='C24':
    fm=24
    fc=21
    E=7400
elif str.upper(Str)=='C18':
    fm=18
    fc=18
    E=6000
elif str.upper(Str)=='C14':
    fm=14
    fc=16
    E=4700
elif str.upper(Str)=='GL32H':
    fm=32
    fc=29
    E=11100
elif str.upper(Str)=='GL28H':
    fm=38
    fc=26.5
    E=10200
elif str.upper(Str)=='GL24H':
    fm=24
    fc=24
    E=9400

if WidthProfile>0 and HeightProfile>0:
    W=[WidthProfile]
    H=[HeightProfile]
    Input=0
elif str.lower(ToW)=='sawn':
    W=[50,38,50,50,75,50,50,63,50,50,100,50,75,75,75,125,75,100,150,100,175,200]
    H=[50,73,75,100,75,125,150,125,175,200,100,225,150,175,200,125,225,200,150,225,175,200]
    Input=1
elif str.lower(ToW)=='planed':
    W=[45,45,45,70,45,45,45,45,95,45,70,70,70,120,70,95,145,95,170,195]
    H=[45,70,95,70,120,145,170,195,95,220,145,170,195,120,220,195,145,220,170,195]
    Input=1
elif str.lower(ToW)=='glulam':
    w=[185,160,140,115,90,65,185,160,140,115,90,65,185,160,140,115,90,65,
    185,160,140,115,90,65,185,160,140,115,90,65,185,160,140,115,90,65,
    185,160,140,115,90,65,185,160,140,115,90,65,185,160,140,115,90,65,
    185,160,140,115,90,65,185,160,140,115,90,65,185,160,140,115,90,65,
    185,160,140,115,90,65,185,160,140,115,90,65,185,160,140,115,90,65,
    185,160,140,115,90,65,185,160,140,115,90,65,185,160,140,115,90,65,
    185,160,140,115,90,65,185,160,140,115,90,65,185,160,140,115,90,65,
    185,160,140,115,90,65,185,160,140,115,90,65,185,160,140,115,90,65,
    185,160,140,115,90,65,185,160,140,115,90,65,185,160,140,115,90,65,
    185,160,140,115,90,65,185,160,140,115,90,65,185,160,140,115,90,65,
    185,160,140,115,90,65,185,160,140,115,90,65,185,160,140,115,90,65,
    185,160,140,115,90,65,185,160,140,115,90,65,185,160,140,115,90,65,
    185,160,140,115,90,65,185,160,140,115,90,65,185,160,140,115,90,65,
    185,160,140,115,90,65,185,160,140,115,90,65,185,160,140,115,90,65,
    185,160,140,115,90,65]
    h=[100,100,100,100,100,100,133,133,133,133,133,133,167,167,167,167,167,167,
    200,200,200,200,200,200,233,233,233,233,233,233,267,267,267,267,267,267,
    300,300,300,300,300,300,333,333,333,333,333,333,367,367,367,367,367,367,
    400,400,400,400,400,400,433,433,433,433,433,433,467,467,467,467,467,467,
    500,500,500,500,500,500,533,533,533,533,533,533,567,567,567,567,567,567,
    600,600,600,600,600,600,633,633,633,633,633,633,667,667,667,667,667,667,
    700,700,700,700,700,700,733,733,733,733,733,733,767,767,767,767,767,767,
    800,800,800,800,800,800,833,833,833,833,833,833,867,867,867,867,867,867,
    900,900,900,900,900,900,933,933,933,933,933,933,967,967,967,967,967,967,
    1000,1000,1000,1000,1000,1000,1033,1033,1033,1033,1033,1033,1067,1067,1067,1067,1067,1067,
    1100,1100,1100,1100,1100,1100,1133,1133,1133,1133,1133,1133,1167,1167,1167,1167,1167,1167,
    1200,1200,1200,1200,1200,1200,1233,1233,1233,1233,1233,1233,1267,1267,1267,1267,1267,1267,
    1300,1300,1300,1300,1300,1300,1333,1333,1333,1333,1333,1333,1367,1367,1367,1367,1367,1367,
    1400,1400,1400,1400,1400,1400,1433,1433,1433,1433,1433,1433,1467,1467,1467,1467,1467,1467,
    1500,1500,1500,1500,1500,1500]
    A=[]
    for i in range(len(w)):
        A.append(w[i]*h[i]) 
    W = [x for _,x in sorted(zip(A,w))]
    H = [x for _,x in sorted(zip(A,h))]
    Input=1

#Wood species
if WS==1:
    Bn=0.65
elif WS==2:
    Bn=0.65
elif WS==3:
    Bn=0.5
elif WS==4:
    Bn=1
else:
    Bn=0.65

#Sides exposed to fire
SEF = m.ceil(SEF)
if SEF>8:
    SEF=8

"""-------------------------------------------------------------------------"""
# CALCULATION OF CROSS SECTION AFTER FIRE
# Charring layer
dchar = t*Bn

# Cross section after fire
wr = [] 
hr = []
for i in range(len(W)):
    if SEF==1:
        wr.append(W[i])
        hr.append(H[i]-dchar)
    elif SEF==2:
        wr.append(W[i]-dchar)
        hr.append(H[i])
    elif SEF==3:
        wr.append(W[i]-dchar)
        hr.append(H[i]-dchar)
    elif SEF==4:
        wr.append(W[i]-2*dchar)
        hr.append(H[i]-dchar)
    elif SEF==5:
        wr.append(W[i]-dchar)
        hr.append(H[i]-2*dchar)
    elif SEF==6:
        wr.append(W[i])
        hr.append(H[i]-2*dchar)
    elif SEF==7:
        wr.append(W[i]-2*dchar)
        hr.append(H[i])
    elif SEF==8:
        wr.append(W[i]-2*dchar)
        hr.append(H[i]-2*dchar)

Wr = [] 
Hr = []
w = []
h = []
for i in range(len(wr)):
    if wr[i]>0 and hr[i]>0:
        Wr.append(wr[i])
        Hr.append(hr[i])
        w.append(W[i])
        h.append(H[i])

"""-------------------------------------------------------------------------"""
# Calculation of new moment of inertia
# Area of 1 corner
r = dchar
Acr = r**2*(1-m.pi/4)
# Moment of inertia corner
Ir = 0.00742*r**4
# Distance to center of gravity corner
sr = 0.223*r

Ar = []     #Area of cross section with rounded corners
S = []      #Static moment about original axis
Sh = []     #Static moment about original axis case 3
Sw = []     #Static moment about original axis case 3
drh = []     #Displacement of axis for corners
drw = []     #Displacement of axis for corners
Iysq = []   #Moment of inertia around z axis rectangle
Izsq = []   #Moment of inertia around y axis rectangle
Iycr = []   #Moment of inertia corner z axis corner
Izcr = []   #Moment of inertia corner y axis corner
Iytot = []  #Moment of inertia combined z axis total
Iztot = []  #Moment of inertia combined y axis total
Pr = []     #Perimeter


# Sides exposed to fire
# Width, Height, 2*Width, 2*Height same calculations
if SEF==1 or SEF==2 or SEF==6 or SEF== 7:  
    for i in range(len(Wr)):
        Iytot.append(1/12*Wr[i]*Hr[i]**3)
        Iztot.append(1/12*Hr[i]*Wr[i]**3)
        Pr.append(2*Wr[i]+2*Hr[i])
        Ar.append(Wr[i]*Hr[i])

# Width + Height
elif SEF==3:
    for i in range(len(Wr)):
        Ar.append((Wr[i]*Hr[i])-Acr)
        Sh.append(Acr*(Hr[i]/2-sr))
        drh.append(Sh[i]/Ar[i])
        Iysq.append(1/12*Wr[i]*(Hr[i]-2*drh[i])**3+1/12*Wr[i]*(2*drh[i])**3+Wr[i]*2*drh[i]*(Hr[i]/2)**2)
        Iycr.append(Ir+Acr*((Hr[i]/2)+drh[i]-sr)**2)
        Iytot.append(Iysq[i]-Iycr[i])
        Sw.append(Acr*(Wr[i]/2-sr))
        drw.append(Sw[i]/Ar[i])
        Izsq.append(1/12*Hr[i]*(Wr[i]-2*drh[i])**3+1/12*Hr[i]*(2*drh[i])**3+Hr[i]*2*drh[i]*(Wr[i]/2)**2)
        Izcr.append(Ir+Acr*((Wr[i]/2)+drw[i]-sr)**2)
        Iztot.append(Izsq[i]-Izcr[i])
        Pr.append(Hr[i]+(Hr[i]-r)+Wr[i]+(Wr[i]-r)+(m.pi*r*2)/4)

# Width + 2*Height 
elif SEF==4: 
    for i in range(len(Wr)):
        Ar.append(Wr[i]*Hr[i]-2*Acr)
        S.append(2*Acr*(Hr[i]/2-sr))
        drh.append(S[i]/Ar[i])
        Iysq.append(1/12*Wr[i]*(Hr[i]-2*drh[i])**3+1/12*Wr[i]*(2*drh[i])**3+Wr[i]*2*drh[i]*(Hr[i]/2)**2)
        Iycr.append(2*Ir+2*Acr*((Hr[i]/2)+drh[i]-sr)**2)
        Iytot.append(Iysq[i]-Iycr[i])
        Izsq.append((1/12*Hr[i]*Wr[i]**3))
        Izcr.append(2*Ir+2*Acr*((Wr[i]/2)-sr)**2)
        Iztot.append(Izsq[i]-Izcr[i])
        Pr.append((Wr[i])+2*(Hr[i]-r)+(Wr[i]-2*r)+(2*(m.pi*r*2)/4))

# 2*Width + Height
elif SEF==5:
    for i in range(len(Wr)):
        Ar.append(Hr[i]*Wr[i]-2*Acr)
        S.append(2*Acr*(Wr[i]/2-sr))
        drw.append(S[i]/Ar[i])
        Iysq.append(1/12*Hr[i]*(Wr[i]-2*drw[i])**3+1/12*Hr[i]*(2*drw[i])**3+Hr[i]*2*drw[i]*(Wr[i]/2)**2)
        Iycr.append(2*Ir+2*Acr*((Wr[i]/2)+drw[i]-sr)**2)
        Iytot.append(Iysq[i]-Iycr[i])
        Izsq.append((1/12*Wr[i]*Hr[i]**3))
        Izcr.append(2*Ir+2*Acr*((Hr[i]/2)-sr)**2)
        Iztot.append(Izsq[i]-Izcr[i])
        Pr.append((Hr[i]+2*(Wr[i]-r)+(Hr[i]-2*r)+(2*(m.pi*r*2)/4)))

# 2*Width + 2*Height
elif SEF==8: 
    for i in range(len(Wr)):
        Ar.append(Wr[i]*Hr[i]-4*Acr)
        Iytot.append(1/12*Wr[i]*Hr[i]**3-r**2*(4-m.pi)*(Hr[i]/2-sr)**2-4*Ir)
        Iztot.append(1/12*Hr[i]*Wr[i]**3-r**2*(4-m.pi)*(Wr[i]/2-sr)**2-4*Ir)
        Pr.append(2*(Hr[i]-2*r)+2*(Wr[i]-2*r)+m.pi*r*2)

else:
    print('You are doing something wrong')
Iy=Iytot
Iz=Iztot

"""-------------------------------------------------------------------------"""
# Verification of wooden beam 
sigmafire = []
for i in range(len(Wr)):
    sigmafire.append(Mmax/Iy[i]*Hr[i]/2)

if Input==0:
    if 0<sigmafire[i]<fm:
       Width = WidthProfile
       Height = HeightProfile
       Sigmafire = sigmafire[0]
       Utilization = Sigmafire/fm*100
    else:
        ErrorMessage='No profiles with selected citeria can support the load'
else:
    # Selecting the smallest profile with capability to support the load
    Wi = []
    He = []
    fmfire = []
    for i in range(len(Wr)):
        if 0<sigmafire[i]<fm:
            Wi.append(w[i])
            He.append(h[i])
            fmfire.append(sigmafire[i])
    if len(Wi)>0:
        Width = Wi[0]
        Height = He[0]
        Sigmafire = fmfire[0]
        Utilization = Sigmafire/fm*100
    else:
        ErrorMessage='No profiles with selected citeria can support the load'



"""-------------------------------------------------------------------------"""
# 3D model for "baking"
if Sigmafire>fm:
    End = rs.CurveEndPoint(CL)
    Start = rs.CurveStartPoint(CL)
    Vector = rs.VectorAdd(Start,End)
    Plane = rs.PlaneFromNormal(Start,Vector)
    CrossSection = rs.AddRectangle(Plane, Height, Width)
    #Translation vector center
    Vec1 =rs.VectorAdd([0,0,0],[-Width/2,0,-Height/2])
    Geo = rs.MoveObject(rs.ExtrudeCurve(CrossSection,CL),Vec1)
    rs.CapPlanarHoles(Geo)
# ---------- end beam_stdfire_sr ----------
column_stdfire_sr = PythonScript(
    CL=crv_3,
    F=Slider(32000, range=0..1000000),
    Str="c24",
    Sup=Slider(1, range=0..10),
    ToW="sawn",
    WidthProfile=Slider(0, range=0..1000),
    HeightProfile=Slider(0, range=0..1000),
    WS=Slider(1, range=0..10),
    t=time_of_exposure_3,
    SEF=Slider(1, range=1..8))  # -> ErrorMessage, Utilization, NRcfire, Width, Height, Geo; inputs CL: Curve
# ---------- column_stdfire_sr: Python ----------
"""
Column - Standard fire with strength reduction method

    Args:
        CL: Center Line for column
        F: Vertical load,N, for the column to support (Calculated as a centrally placed load, also in the case when the column's center of gravity moves)
        Str: Strength class for the wood (C30, C24, C18, C14, GL32h, GL28h or GL24h)[Default: 24C]
        Sup: Support conditions for the column (1=Simply supported both ends, 2=One end fixed and one end not supported, 3=One end fixed and one end simply supported, 4=Both ends fixed [Default: Simply supported]
        ToW: Type of Wood; Sawn, Planed or Glulam (Glued laminated timber) standard profiles [Default: sawn]
        WidthProfile: Width of profile [mm] to calculate NRc,fire for. If no value is inserted, the NRc,fire is calculated based on ToW.
        HeightProfile: Height of profile [mm] to calculate NRc,fire for. If no value is inserted, the NRc,fire is calculated based on ToW.
        WS: Wood Species (1=Conifer p>290 kg/m3, 2=Laminated wood p>290 kg/m3 , 3=Hardwood p>450 kg/m3 [Default: Conifer]
        t: Time of exposure in minutes [Default 60]
        SEF: Sides Exposed to Fire(1=Width, 2=Height, 3=Width+Height, 4=Width+2*Height, 5=2*Width+Height, 6=2*Width, 7=2*Height, 8=All [Default: All]
    Returns:
        NRc,fire: Charateristic resistance of the column after fire [kN]
        Width: Width of the cross section before fire [mm]
        Height: Height of the cross section before fire [mm]
        Geo: 3D model of the cross section
        Utilization: Utilization rate [%]
        ErrorMessage: Check this output for error messages

"""

import rhinoscriptsyntax as rs
import math as m

"""-------------------------------------------------------------------------"""
# USER INPUTS
StrDef = 'c24'
SupDef = 1
ToWDef = 'sawn'
WSDef = 1
tDef = 60
SEFDef = 8

if not Str:
    Str=StrDef
if not Sup:
    Sup=SupDef
if not ToW:
    ToW=ToWDef
if not WS:
    WS=WSDef
if not t:
    t=tDef
if not SEF:
    SEF=SEFDef

# Support conditions
if Sup==1:
    l0=1
elif Sup==2:
    l0=2
elif Sup==3:
    l0=0.699
elif Sup==4:
    l0=1/2
else:
    l0=1

# Strength class
if str.upper(Str)=='C30':
    fm=30
    fc=23
    E=8000
elif str.upper(Str)=='C24':
    fm=24
    fc=21
    E=7400
elif str.upper(Str)=='C18':
    fm=18
    fc=18
    E=6000
elif str.upper(Str)=='C14':
    fm=14
    fc=16
    E=4700
elif str.upper(Str)=='GL32H':
    fm=32
    fc=29
    E=11100
elif str.upper(Str)=='GL28H':
    fm=38
    fc=26.5
    E=10200
elif str.upper(Str)=='GL24H':
    fm=24
    fc=24
    E=9400

if WidthProfile>0 and HeightProfile>0:
    W=[WidthProfile]
    H=[HeightProfile]
    Bc=0.1
    Input=0
elif str.lower(ToW)=='sawn':
    W=[50,38,50,50,75,50,50,63,50,50,100,50,75,75,75,125,75,100,150,100,175,200]
    H=[50,73,75,100,75,125,150,125,175,200,100,225,150,175,200,125,225,200,150,225,175,200]
    Bc=0.2
    Input=1
elif str.lower(ToW)=='planed':
    W=[45,45,45,70,45,45,45,45,95,45,70,70,70,120,70,95,145,95,170,195]
    H=[45,70,95,70,120,145,170,195,95,220,145,170,195,120,220,195,145,220,170,195]
    Bc=0.2
    Input=1
elif str.lower(ToW)=='glulam':
    w=[185,160,140,115,90,65,185,160,140,115,90,65,185,160,140,115,90,65,
    185,160,140,115,90,65,185,160,140,115,90,65,185,160,140,115,90,65,
    185,160,140,115,90,65,185,160,140,115,90,65,185,160,140,115,90,65,
    185,160,140,115,90,65,185,160,140,115,90,65,185,160,140,115,90,65,
    185,160,140,115,90,65,185,160,140,115,90,65,185,160,140,115,90,65,
    185,160,140,115,90,65,185,160,140,115,90,65,185,160,140,115,90,65,
    185,160,140,115,90,65,185,160,140,115,90,65,185,160,140,115,90,65,
    185,160,140,115,90,65,185,160,140,115,90,65,185,160,140,115,90,65,
    185,160,140,115,90,65,185,160,140,115,90,65,185,160,140,115,90,65,
    185,160,140,115,90,65,185,160,140,115,90,65,185,160,140,115,90,65,
    185,160,140,115,90,65,185,160,140,115,90,65,185,160,140,115,90,65,
    185,160,140,115,90,65,185,160,140,115,90,65,185,160,140,115,90,65,
    185,160,140,115,90,65,185,160,140,115,90,65,185,160,140,115,90,65,
    185,160,140,115,90,65,185,160,140,115,90,65,185,160,140,115,90,65,
    185,160,140,115,90,65]
    h=[100,100,100,100,100,100,133,133,133,133,133,133,167,167,167,167,167,167,
    200,200,200,200,200,200,233,233,233,233,233,233,267,267,267,267,267,267,
    300,300,300,300,300,300,333,333,333,333,333,333,367,367,367,367,367,367,
    400,400,400,400,400,400,433,433,433,433,433,433,467,467,467,467,467,467,
    500,500,500,500,500,500,533,533,533,533,533,533,567,567,567,567,567,567,
    600,600,600,600,600,600,633,633,633,633,633,633,667,667,667,667,667,667,
    700,700,700,700,700,700,733,733,733,733,733,733,767,767,767,767,767,767,
    800,800,800,800,800,800,833,833,833,833,833,833,867,867,867,867,867,867,
    900,900,900,900,900,900,933,933,933,933,933,933,967,967,967,967,967,967,
    1000,1000,1000,1000,1000,1000,1033,1033,1033,1033,1033,1033,1067,1067,1067,1067,1067,1067,
    1100,1100,1100,1100,1100,1100,1133,1133,1133,1133,1133,1133,1167,1167,1167,1167,1167,1167,
    1200,1200,1200,1200,1200,1200,1233,1233,1233,1233,1233,1233,1267,1267,1267,1267,1267,1267,
    1300,1300,1300,1300,1300,1300,1333,1333,1333,1333,1333,1333,1367,1367,1367,1367,1367,1367,
    1400,1400,1400,1400,1400,1400,1433,1433,1433,1433,1433,1433,1467,1467,1467,1467,1467,1467,
    1500,1500,1500,1500,1500,1500]
    A=[]
    for i in range(len(w)):
        A.append(w[i]*h[i]) 
    W = [x for _,x in sorted(zip(A,w))]
    H = [x for _,x in sorted(zip(A,h))]
    Bc=0.1
    Input=1

#Wood species
if WS==1:
    Bn=0.65
elif WS==2:
    Bn=0.65
elif WS==3:
    Bn=0.5
elif WS==4:
    Bn=1
else:
    Bn=0.65

#Sides exposed to fire
SEF = m.ceil(SEF)
if SEF>8:
    SEF=8
if SEF==1 or SEF==2 or SEF==3 or SEF==5 or SEF==6:
    a=1
else:
    a=2

"""-------------------------------------------------------------------------"""
# CALCULATION OF CROSS SECTION AFTER FIRE
# Charring layer
dchar = t*Bn

# Check for bmin
if dchar < 13:
    bmin = 8.15*dchar
else:
    bmin = a*dchar+80
W = [x for x in W if x > bmin]
H = [x for x in W if x > bmin]

# Cross section after fire
wr = [] 
hr = []
for i in range(len(W)):
    if SEF==1:
        wr.append(W[i])
        hr.append(H[i]-dchar)
    elif SEF==2:
        wr.append(W[i]-dchar)
        hr.append(H[i])
    elif SEF==3:
        wr.append(W[i]-dchar)
        hr.append(H[i]-dchar)
    elif SEF==4:
        wr.append(W[i]-2*dchar)
        hr.append(H[i]-dchar)
    elif SEF==5:
        wr.append(W[i]-dchar)
        hr.append(H[i]-2*dchar)
    elif SEF==6:
        wr.append(W[i])
        hr.append(H[i]-2*dchar)
    elif SEF==7:
        wr.append(W[i]-2*dchar)
        hr.append(H[i])
    elif SEF==8:
        wr.append(W[i]-2*dchar)
        hr.append(H[i]-2*dchar)

Wr = []
Hr = []
w = []
h = []
for i in range(len(wr)):
    if wr[i]>0 and hr[i]>0:
        Wr.append(wr[i])
        Hr.append(hr[i])
        w.append(W[i])
        h.append(H[i])

"""-------------------------------------------------------------------------"""
# Calculation of new moment of inertia
# Area of 1 corner
r = dchar
Acr = r**2*(1-m.pi/4)
# Moment of inertia corner
Ir = 0.00742*r**4
# Distance to center of gravity corner
sr = 0.223*r

Ar = []     #Area of cross section with rounded corners
S = []      #Static moment about original axis
Sh = []     #Static moment about original axis case 3
Sw = []     #Static moment about original axis case 3
drh = []     #Displacement of axis for corners
drw = []     #Displacement of axis for corners
Iysq = []   #Moment of inertia around z axis rectangle
Izsq = []   #Moment of inertia around y axis rectangle
Iycr = []   #Moment of inertia corner z axis corner
Izcr = []   #Moment of inertia corner y axis corner
Iytot = []  #Moment of inertia combined z axis total
Iztot = []  #Moment of inertia combined y axis total
Pr = []     #Perimeter


# Sides exposed to fire
# Width, Height, 2*Width, 2*Height same calculations
if SEF==1 or SEF==2 or SEF==6 or SEF== 7:  
    for i in range(len(Wr)):
        Iytot.append(1/12*Wr[i]*Hr[i]**3)
        Iztot.append(1/12*Hr[i]*Wr[i]**3)
        Pr.append(2*Wr[i]+2*Hr[i])
        Ar.append(Wr[i]*Hr[i])

# Width + Height
elif SEF==3:
    for i in range(len(Wr)):
        Ar.append((Wr[i]*Hr[i])-Acr)
        Sh.append(Acr*(Hr[i]/2-sr))
        drh.append(Sh[i]/Ar[i])
        Iysq.append(1/12*Wr[i]*(Hr[i]-2*drh[i])**3+1/12*Wr[i]*(2*drh[i])**3+Wr[i]*2*drh[i]*(Hr[i]/2)**2)
        Iycr.append(Ir+Acr*((Hr[i]/2)+drh[i]-sr)**2)
        Iytot.append(Iysq[i]-Iycr[i])
        Sw.append(Acr*(Wr[i]/2-sr))
        drw.append(Sw[i]/Ar[i])
        Izsq.append(1/12*Hr[i]*(Wr[i]-2*drh[i])**3+1/12*Hr[i]*(2*drh[i])**3+Hr[i]*2*drh[i]*(Wr[i]/2)**2)
        Izcr.append(Ir+Acr*((Wr[i]/2)+drw[i]-sr)**2)
        Iztot.append(Izsq[i]-Izcr[i])
        Pr.append(Hr[i]+(Hr[i]-r)+Wr[i]+(Wr[i]-r)+(m.pi*r*2)/4)

# Width + 2*Height 
elif SEF==4: 
    for i in range(len(Wr)):
        Ar.append(Wr[i]*Hr[i]-2*Acr)
        S.append(2*Acr*(Hr[i]/2-sr))
        drh.append(S[i]/Ar[i])
        Iysq.append(1/12*Wr[i]*(Hr[i]-2*drh[i])**3+1/12*Wr[i]*(2*drh[i])**3+Wr[i]*2*drh[i]*(Hr[i]/2)**2)
        Iycr.append(2*Ir+2*Acr*((Hr[i]/2)+drh[i]-sr)**2)
        Iytot.append(Iysq[i]-Iycr[i])
        Izsq.append((1/12*Hr[i]*Wr[i]**3))
        Izcr.append(2*Ir+2*Acr*((Wr[i]/2)-sr)**2)
        Iztot.append(Izsq[i]-Izcr[i])
        Pr.append((Wr[i])+2*(Hr[i]-r)+(Wr[i]-2*r)+(2*(m.pi*r*2)/4))

# 2*Width + Height
elif SEF==5:
    for i in range(len(Wr)):
        Ar.append(Hr[i]*Wr[i]-2*Acr)
        S.append(2*Acr*(Wr[i]/2-sr))
        drw.append(S[i]/Ar[i])
        Iysq.append(1/12*Hr[i]*(Wr[i]-2*drw[i])**3+1/12*Hr[i]*(2*drw[i])**3+Hr[i]*2*drw[i]*(Wr[i]/2)**2)
        Iycr.append(2*Ir+2*Acr*((Wr[i]/2)+drw[i]-sr)**2)
        Iytot.append(Iysq[i]-Iycr[i])
        Izsq.append((1/12*Wr[i]*Hr[i]**3))
        Izcr.append(2*Ir+2*Acr*((Hr[i]/2)-sr)**2)
        Iztot.append(Izsq[i]-Izcr[i])
        Pr.append((Hr[i]+2*(Wr[i]-r)+(Hr[i]-2*r)+(2*(m.pi*r*2)/4)))

# 2*Width + 2*Height
elif SEF==8: 
    for i in range(len(Wr)):
        Ar.append(Wr[i]*Hr[i]-4*Acr)
        Iytot.append(1/12*Wr[i]*Hr[i]**3-r**2*(4-m.pi)*(Hr[i]/2-sr)**2-4*Ir)
        Iztot.append(1/12*Hr[i]*Wr[i]**3-r**2*(4-m.pi)*(Wr[i]/2-sr)**2-4*Ir)
        Pr.append(2*(Hr[i]-2*r)+2*(Wr[i]-2*r)+m.pi*r*2)

else:
    print('You are doing something wrong')
Iy=Iytot
Iz=Iztot
"""-------------------------------------------------------------------------"""

# Verification of wooden column (Calculation of NRc,fire)
# Critical buckling length
ls = rs.CurveLength(CL)

# Checking for weakest axis
I = []
for i in range(len(Wr)):
    if Hr[i]>Wr[i]:
        I.append(Iz[i])
    else:
        I.append(Iy[i])

CStr =[]       # Reduction factor for compression strength
FStr = []      # Reduction factor for flexural strength
EStr = []     # Reduction factor for tensile and shear strength

for i in range(len(Pr)):
    if t<20:
        CStr.append(1-1/125*Pr[i]/Ar[i]*t/20)
        FStr.append(1-1/200*Pr[i]/Ar[i]*t/20)
        EStr.append(1-1/330*Pr[i]/Ar[i]*t/20)
    else:
        CStr.append(1-1/125*Pr[i]/Ar[i])
        FStr.append(1-1/200*Pr[i]/Ar[i])
        EStr.append(1-1/330*Pr[i]/Ar[i])

Lambda = []
SigmaE = []  
kmod1 = []  
kmod2 = []
Lambdarel = [] 
kfire = []
kc = []
Nrcfire = []

for i in range(len(Wr)):
    #Slenderness ratio
    Lambda.append(ls/m.sqrt(I[i]/Ar[i]))
    #Euler stress
    SigmaE.append(m.pi**2*((E*EStr[i])/(fc*CStr[i])))
    #Relative slenderness ratio
    Lambdarel.append(Lambda[i]/m.sqrt(SigmaE[i]))
    #kfire coefficient
    kfire.append(0.5*(1+Bc*(Lambdarel[i]-0.5)+Lambdarel[i]**2))
    #Critical buckling factor
    if Lambdarel[i]<0.5:
        kc.append(1.0)
    else:
        kc.append(1/(kfire[i]+m.sqrt(kfire[i]**2-Lambdarel[i]**2)))
    #Characteristic resistance of wood
    Nrcfire.append(Ar[i]*fc*kc[i])

if Input==0:
    if Nrcfire>F:
        Width = WidthProfile
        Height = HeightProfile
        NRcfire = Nrcfire
        Utilization = F/NRcfire[0]
    else:
        ErrorMessage='No profiles with selected citeria can support the load'
else:
# Selecting the smallest profile with capability to support the load
    Wi = []
    He = []
    NRc =[]
    for i in range(len(Wr)):
        if Nrcfire[i]>F:
            Wi.append(w[i])
            He.append(h[i])
            NRc.append(Nrcfire[i])
    if len(Wi)>0:
        Width = Wi[0]
        Height = He[0]
        NRcfire = NRc[0]
        Utilization = F/NRcfire
    else:
        ErrorMessage='No profiles with selected citeria can support the load'
print 

"""-------------------------------------------------------------------------"""
# 3D model for "baking"
if NRcfire>F:
    End = rs.CurveEndPoint(CL)
    Start = rs.CurveStartPoint(CL)
    Vector = rs.VectorAdd(Start,End)
    Plane = rs.PlaneFromNormal(Start,Vector)
    CrossSection = rs.AddRectangle(Plane, Width, Height)
    #Translation vector center
    Vec1 =rs.VectorAdd([0,0,0],[-Width/2,-Height/2,0])
    Geo = rs.MoveObject(rs.ExtrudeCurve(CrossSection,CL),Vec1)
    rs.CapPlanarHoles(Geo)
# ---------- end column_stdfire_sr ----------
panel_10 = Panel(beam_stdfire_sr.Height)
panel_11 = Panel(column_stdfire_sr.Utilization)
panel_12 = Panel(column_stdfire_sr.NRcfire)
panel_13 = Panel(column_stdfire_sr.Width)
panel_14 = Panel(column_stdfire_sr.Height)
panel_15 = Panel(beam_stdfire_sr.Utilization)
panel_16 = Panel(beam_stdfire_sr.Width)

pt_9 = ConstructPoint(XCoordinate=0, YCoordinate=0, ZCoordinate=0)
panel_17 = Panel("PARAMETRIC FIRE")
pt_10 = ConstructPoint(XCoordinate=0, YCoordinate=0, ZCoordinate=Slider(4000, range=0..10000))
pt_11 = ConstructPoint(XCoordinate=0, YCoordinate=0, ZCoordinate=0)
pt_12 = ConstructPoint(XCoordinate=0, YCoordinate=Slider(4000, range=0..10000), ZCoordinate=0)
ln_5 = Line(StartPoint=pt_9, EndPoint=pt_10)
ln_6 = Line(StartPoint=pt_11, EndPoint=pt_12)
time_of_exposure_5 = Slider(60, range=0..120)
time_of_exposure_6 = Slider(77, range=0..120)
number_slider = Slider(1058, range=0..10000)
number_slider_2 = Slider(527, range=0..1000)
crv_5 = Curve(ln_5)
crv_6 = Curve(ln_6)
column_paramfire_sr = PythonScript(
    CL=crv_5,
    F=Slider(34398, range=0..1000000),
    Str="c24",
    Sup=Slider(1, range=0..10),
    ToW="sawn",
    WidthProfile=Slider(0, range=0..1000),
    HeightProfile=Slider(0, range=0..1000),
    WS=Slider(1, range=0..10),
    t=time_of_exposure_5,
    SEF=Slider(1, range=1..8),
    O=Slider(0.4, range=0..1),
    q=400,
    Ti=1160)  # -> ErrorMessage, Utilization, NRcfire, Width, Height, Geo; inputs CL: Curve
# ---------- column_paramfire_sr: Python ----------
"""
Column - Parametric fire with strength reduction method

    Args:
        CL: Center Line for column
        F: Vertical load,N, for the column to support (Calculated as a centrally placed load, also in the case when the column's center of gravity moves)
        Str: Strength class for the wood (C30, C24, C18, C14, GL32h, GL28h or GL24h) [Default: C24]
        Sup: Support conditions for the column (1=Simply supported both ends, 2=One end fixed and one end not supported, 3=One end fixed and one end simply supported, 4=Both ends fixed [Default: Simply supported]
        ToW: Type of Wood; Sawn, Planed or Glulam (Glued laminated timber) standard profiles.
        WidthProfile: Width of profile [mm] to calculate NRc,fire for. If no value is inserted, the NRc,fire is calculated on ToW.
        HeightProfile: Height of profile [mm] to calculate NRc,fire for. If no value is inserted, the NRc,fire is calculated on ToW.
        WS: Wood Species (1=Conifer p>290 kg/m3, 2=Laminated wood p>290 kg/m3 , 3=Hardwood p>450 kg/m3, 4=Plywood with a thickness d>20 mm and density p>450 kg/m3 [Default: Conifer]
        t: Time of exposure in minutes [Default: 60]
        SEF: Sides Exposed to Fire(1=Width, 2=Height, 3=Width+Height, 4=Width+2*Height, 5=2*Width+Height, 6=2*Width, 7=2*Height, 8=All [Default: All]
        O: Opening factor [m1/2] [Default: 0.4]
        q: Fireload [MJ/m2] [Default: 400]
        Ti: Thermal inertia [Default: 1160]
    Returns:
        NRc,fire: Charateristic resistance of the column after fire [kN]
        Width: Width of the cross section before fire
        Height: Height of the cross section before fire
        Geo: 3D model of the cross section
        Utilization: Utilization rate [%]
        ErrorMessage: Check this output for error messages

"""

import rhinoscriptsyntax as rs
import math as m

"""-------------------------------------------------------------------------"""
# USER INPUTS
StrDef = 'c24'
SupDef = 1
ToWDef = 'sawn'
WSDef = 1
tDef = 60
SEFDef = 8
ODef= 0.4
qDef = 400
TiDef = 1160

if not Str:
    Str=StrDef
if not Sup:
    Sup=SupDef
if not ToW:
    ToW=ToWDef
if not WS:
    WS=WSDef
if not t:
    t=tDef
if not SEF:
    SEF=SEFDef
if not O:
    O=ODef
if not q:
    q=qDef
if not Ti:
    Ti=TiDef

# Support conditions
if Sup==1:
    l0=1
elif Sup==2:
    l0=2
elif Sup==3:
    l0=0.699
elif Sup==4:
    l0=1/2
else:
    l0=1

# Strength class
if str.upper(Str)=='C30':
    fm=30
    fc=23
    E=8000
elif str.upper(Str)=='C24':
    fm=24
    fc=21
    E=7400
elif str.upper(Str)=='C18':
    fm=18
    fc=18
    E=6000
elif str.upper(Str)=='C14':
    fm=14
    fc=16
    E=4700
elif str.upper(Str)=='GL32H':
    fm=32
    fc=29
    E=11100
elif str.upper(Str)=='GL28H':
    fm=38
    fc=26.5
    E=10200
elif str.upper(Str)=='GL24H':
    fm=24
    fc=24
    E=9400

if WidthProfile>0 and HeightProfile>0:
    W=[WidthProfile]
    H=[HeightProfile]
    Bc=0.1
    Input=0
elif str.lower(ToW)=='sawn':
    W=[50,38,50,50,75,50,50,63,50,50,100,50,75,75,75,125,75,100,150,100,175,200]
    H=[50,73,75,100,75,125,150,125,175,200,100,225,150,175,200,125,225,200,150,225,175,200]
    Bc=0.2
    Input=1
elif str.lower(ToW)=='planed':
    W=[45,45,45,70,45,45,45,45,95,45,70,70,70,120,70,95,145,95,170,195]
    H=[45,70,95,70,120,145,170,195,95,220,145,170,195,120,220,195,145,220,170,195]
    Bc=0.2
    Input=1
elif str.lower(ToW)=='glulam':
    w=[185,160,140,115,90,65,185,160,140,115,90,65,185,160,140,115,90,65,
    185,160,140,115,90,65,185,160,140,115,90,65,185,160,140,115,90,65,
    185,160,140,115,90,65,185,160,140,115,90,65,185,160,140,115,90,65,
    185,160,140,115,90,65,185,160,140,115,90,65,185,160,140,115,90,65,
    185,160,140,115,90,65,185,160,140,115,90,65,185,160,140,115,90,65,
    185,160,140,115,90,65,185,160,140,115,90,65,185,160,140,115,90,65,
    185,160,140,115,90,65,185,160,140,115,90,65,185,160,140,115,90,65,
    185,160,140,115,90,65,185,160,140,115,90,65,185,160,140,115,90,65,
    185,160,140,115,90,65,185,160,140,115,90,65,185,160,140,115,90,65,
    185,160,140,115,90,65,185,160,140,115,90,65,185,160,140,115,90,65,
    185,160,140,115,90,65,185,160,140,115,90,65,185,160,140,115,90,65,
    185,160,140,115,90,65,185,160,140,115,90,65,185,160,140,115,90,65,
    185,160,140,115,90,65,185,160,140,115,90,65,185,160,140,115,90,65,
    185,160,140,115,90,65,185,160,140,115,90,65,185,160,140,115,90,65,
    185,160,140,115,90,65]
    h=[100,100,100,100,100,100,133,133,133,133,133,133,167,167,167,167,167,167,
    200,200,200,200,200,200,233,233,233,233,233,233,267,267,267,267,267,267,
    300,300,300,300,300,300,333,333,333,333,333,333,367,367,367,367,367,367,
    400,400,400,400,400,400,433,433,433,433,433,433,467,467,467,467,467,467,
    500,500,500,500,500,500,533,533,533,533,533,533,567,567,567,567,567,567,
    600,600,600,600,600,600,633,633,633,633,633,633,667,667,667,667,667,667,
    700,700,700,700,700,700,733,733,733,733,733,733,767,767,767,767,767,767,
    800,800,800,800,800,800,833,833,833,833,833,833,867,867,867,867,867,867,
    900,900,900,900,900,900,933,933,933,933,933,933,967,967,967,967,967,967,
    1000,1000,1000,1000,1000,1000,1033,1033,1033,1033,1033,1033,1067,1067,1067,1067,1067,1067,
    1100,1100,1100,1100,1100,1100,1133,1133,1133,1133,1133,1133,1167,1167,1167,1167,1167,1167,
    1200,1200,1200,1200,1200,1200,1233,1233,1233,1233,1233,1233,1267,1267,1267,1267,1267,1267,
    1300,1300,1300,1300,1300,1300,1333,1333,1333,1333,1333,1333,1367,1367,1367,1367,1367,1367,
    1400,1400,1400,1400,1400,1400,1433,1433,1433,1433,1433,1433,1467,1467,1467,1467,1467,1467,
    1500,1500,1500,1500,1500,1500]
    A=[]
    for i in range(len(w)):
        A.append(w[i]*h[i]) 
    W = [x for _,x in sorted(zip(A,w))]
    H = [x for _,x in sorted(zip(A,h))]
    Bc=0.1
    Input=1

#Wood species
if WS==1:
    Bn=0.65
elif WS==2:
    Bn=0.65
elif WS==3:
    Bn=0.5
elif WS==4:
    Bn=1
else:
    Bn=0.65

#Sides exposed to fire
SEF = m.ceil(SEF)
if SEF>8:
    SEF=8
if SEF==1 or SEF==2 or SEF==3 or SEF==5 or SEF==6:
    a=1
else:
    a=2

"""-------------------------------------------------------------------------"""
# CALCULATION OF CROSS SECTION AFTER FIRE
#Maximum duration of fire
t1=0.0145*q/O
#Charring rate
BL=1.25-0.035/((1160/Ti)*O+0.021)
B1=1.5*Bn*BL
# Charring layer
if t<t1/3:
    dchar=B1*t
else:
    dchar=B1/(12*t1)*(-9*t**2+18*t1*t-t1**2)

# Check for bmin
if dchar < 13:
    bmin = 8.15*dchar
else:
    bmin = a*dchar+80
W = [x for x in W if x > bmin]
H = [x for x in W if x > bmin]

# Cross section after fire
wr = [] 
hr = []
for i in range(len(W)):
    if SEF==1:
        wr.append(W[i])
        hr.append(H[i]-dchar)
    elif SEF==2:
        wr.append(W[i]-dchar)
        hr.append(H[i])
    elif SEF==3:
        wr.append(W[i]-dchar)
        hr.append(H[i]-dchar)
    elif SEF==4:
        wr.append(W[i]-2*dchar)
        hr.append(H[i]-dchar)
    elif SEF==5:
        wr.append(W[i]-dchar)
        hr.append(H[i]-2*dchar)
    elif SEF==6:
        wr.append(W[i])
        hr.append(H[i]-2*dchar)
    elif SEF==7:
        wr.append(W[i]-2*dchar)
        hr.append(H[i])
    elif SEF==8:
        wr.append(W[i]-2*dchar)
        hr.append(H[i]-2*dchar)

Wr = []
Hr = []
w = []
h = []
for i in range(len(wr)):
    if wr[i]>0 and hr[i]>0:
        Wr.append(wr[i])
        Hr.append(hr[i])
        w.append(W[i])
        h.append(H[i])

"""-------------------------------------------------------------------------"""
# Calculation of new moment of inertia
# Area of 1 corner
r = dchar
Acr = r**2*(1-m.pi/4)
# Moment of inertia corner
Ir = 0.00742*r**4
# Distance to center of gravity corner
sr = 0.223*r

Ar = []     #Area of cross section with rounded corners
S = []      #Static moment about original axis
Sh = []     #Static moment about original axis case 3
Sw = []     #Static moment about original axis case 3
drh = []     #Displacement of axis for corners
drw = []     #Displacement of axis for corners
Iysq = []   #Moment of inertia around z axis rectangle
Izsq = []   #Moment of inertia around y axis rectangle
Iycr = []   #Moment of inertia corner z axis corner
Izcr = []   #Moment of inertia corner y axis corner
Iytot = []  #Moment of inertia combined z axis total
Iztot = []  #Moment of inertia combined y axis total
Pr = []     #Perimeter


# Sides exposed to fire
# Width, Height, 2*Width, 2*Height same calculations
if SEF==1 or SEF==2 or SEF==6 or SEF== 7:  
    for i in range(len(Wr)):
        Iytot.append(1/12*Wr[i]*Hr[i]**3)
        Iztot.append(1/12*Hr[i]*Wr[i]**3)
        Pr.append(2*Wr[i]+2*Hr[i])
        Ar.append(Wr[i]*Hr[i])

# Width + Height
elif SEF==3:
    for i in range(len(Wr)):
        Ar.append((Wr[i]*Hr[i])-Acr)
        Sh.append(Acr*(Hr[i]/2-sr))
        drh.append(Sh[i]/Ar[i])
        Iysq.append(1/12*Wr[i]*(Hr[i]-2*drh[i])**3+1/12*Wr[i]*(2*drh[i])**3+Wr[i]*2*drh[i]*(Hr[i]/2)**2)
        Iycr.append(Ir+Acr*((Hr[i]/2)+drh[i]-sr)**2)
        Iytot.append(Iysq[i]-Iycr[i])
        Sw.append(Acr*(Wr[i]/2-sr))
        drw.append(Sw[i]/Ar[i])
        Izsq.append(1/12*Hr[i]*(Wr[i]-2*drh[i])**3+1/12*Hr[i]*(2*drh[i])**3+Hr[i]*2*drh[i]*(Wr[i]/2)**2)
        Izcr.append(Ir+Acr*((Wr[i]/2)+drw[i]-sr)**2)
        Iztot.append(Izsq[i]-Izcr[i])
        Pr.append(Hr[i]+(Hr[i]-r)+Wr[i]+(Wr[i]-r)+(m.pi*r*2)/4)

# Width + 2*Height 
elif SEF==4: 
    for i in range(len(Wr)):
        Ar.append(Wr[i]*Hr[i]-2*Acr)
        S.append(2*Acr*(Hr[i]/2-sr))
        drh.append(S[i]/Ar[i])
        Iysq.append(1/12*Wr[i]*(Hr[i]-2*drh[i])**3+1/12*Wr[i]*(2*drh[i])**3+Wr[i]*2*drh[i]*(Hr[i]/2)**2)
        Iycr.append(2*Ir+2*Acr*((Hr[i]/2)+drh[i]-sr)**2)
        Iytot.append(Iysq[i]-Iycr[i])
        Izsq.append((1/12*Hr[i]*Wr[i]**3))
        Izcr.append(2*Ir+2*Acr*((Wr[i]/2)-sr)**2)
        Iztot.append(Izsq[i]-Izcr[i])
        Pr.append((Wr[i])+2*(Hr[i]-r)+(Wr[i]-2*r)+(2*(m.pi*r*2)/4))

# 2*Width + Height
elif SEF==5:
    for i in range(len(Wr)):
        Ar.append(Hr[i]*Wr[i]-2*Acr)
        S.append(2*Acr*(Wr[i]/2-sr))
        drw.append(S[i]/Ar[i])
        Iysq.append(1/12*Hr[i]*(Wr[i]-2*drw[i])**3+1/12*Hr[i]*(2*drw[i])**3+Hr[i]*2*drw[i]*(Wr[i]/2)**2)
        Iycr.append(2*Ir+2*Acr*((Wr[i]/2)+drw[i]-sr)**2)
        Iytot.append(Iysq[i]-Iycr[i])
        Izsq.append((1/12*Wr[i]*Hr[i]**3))
        Izcr.append(2*Ir+2*Acr*((Hr[i]/2)-sr)**2)
        Iztot.append(Izsq[i]-Izcr[i])
        Pr.append((Hr[i]+2*(Wr[i]-r)+(Hr[i]-2*r)+(2*(m.pi*r*2)/4)))

# 2*Width + 2*Height
elif SEF==8: 
    for i in range(len(Wr)):
        Ar.append(Wr[i]*Hr[i]-4*Acr)
        Iytot.append(1/12*Wr[i]*Hr[i]**3-r**2*(4-m.pi)*(Hr[i]/2-sr)**2-4*Ir)
        Iztot.append(1/12*Hr[i]*Wr[i]**3-r**2*(4-m.pi)*(Wr[i]/2-sr)**2-4*Ir)
        Pr.append(2*(Hr[i]-2*r)+2*(Wr[i]-2*r)+m.pi*r*2)

else:
    print('You are doing something wrong')
Iy=Iytot
Iz=Iztot
"""-------------------------------------------------------------------------"""

# Verification of wooden column (Calculation of NRc,fire)
# Critical buckling length
ls = rs.CurveLength(CL)

# Checking for weakest axis
I = []
for i in range(len(Wr)):
    if Hr[i]>Wr[i]:
        I.append(Iz[i])
    else:
        I.append(Iy[i])

CStr =[]       # Reduction factor for compression strength
FStr = []      # Reduction factor for flexural strength
EStr = []     # Reduction factor for tensile and shear strength

for i in range(len(Pr)):
    if t<20:
        CStr.append(1-1/125*Pr[i]/Ar[i]*t/20)
        FStr.append(1-1/200*Pr[i]/Ar[i]*t/20)
        EStr.append(1-1/330*Pr[i]/Ar[i]*t/20)
    else:
        CStr.append(1-1/125*Pr[i]/Ar[i])
        FStr.append(1-1/200*Pr[i]/Ar[i])
        EStr.append(1-1/330*Pr[i]/Ar[i])

Lambda = []
SigmaE = []  
kmod1 = []  
kmod2 = []
Lambdarel = [] 
kfire = []
kc = []
Nrcfire = []

for i in range(len(Wr)):
    #Slenderness ratio
    Lambda.append(ls/m.sqrt(I[i]/Ar[i]))
    #Euler stress
    SigmaE.append(m.pi**2*((E*EStr[i])/(fc*CStr[i])))
    #Relative slenderness ratio
    Lambdarel.append(Lambda[i]/m.sqrt(SigmaE[i]))
    #kfire coefficient
    kfire.append(0.5*(1+Bc*(Lambdarel[i]-0.5)+Lambdarel[i]**2))
    #Critical buckling factor
    if Lambdarel[i]<0.5:
        kc.append(1.0)
    else:
        kc.append(1/(kfire[i]+m.sqrt(kfire[i]**2-Lambdarel[i]**2)))
    #Characteristic resistance of wood
    Nrcfire.append(Ar[i]*fc*kc[i])

if Input==0:
    if Nrcfire>F:
        Width = WidthProfile
        Height = HeightProfile
        NRcfire = Nrcfire
        Utilization = F/NRcfire[0]
    else:
        ErrorMessage='No profiles with selected citeria can support the load'

else:
# Selecting the smallest profile with capability to support the load
    Wi = []
    He = []
    NRc =[]
    for i in range(len(Wr)):
        if Nrcfire[i]>F:
            Wi.append(w[i])
            He.append(h[i])
            NRc.append(Nrcfire[i])
    if len(Wi)>0:
        Width = Wi[0]
        Height = He[0]
        NRcfire = NRc[0]
        Utilization = F/NRcfire
    else:
        ErrorMessage='No profiles with selected citeria can support the load'


"""-------------------------------------------------------------------------"""
# 3D model for "baking"
if NRcfire>F:
    End = rs.CurveEndPoint(CL)
    Start = rs.CurveStartPoint(CL)
    Vector = rs.VectorAdd(Start,End)
    Plane = rs.PlaneFromNormal(Start,Vector)
    CrossSection = rs.AddRectangle(Plane, Width, Height)
    #Translation vector center
    Vec1 =rs.VectorAdd([0,0,0],[-Width/2,-Height/2,0])
    Geo = rs.MoveObject(rs.ExtrudeCurve(CrossSection,CL),Vec1)
    rs.CapPlanarHoles(Geo)
# ---------- end column_paramfire_sr ----------
beam_paramfire_sr = PythonScript(
    CL=crv_6,
    F=Slider(6, range=0..100),
    Str="c24",
    Sup=Slider(1, range=0..10),
    ToW="sawn",
    WidthProfile=Slider(0, range=0..100),
    HeightProfile=Slider(0, range=0..1000),
    WS=Slider(1, range=0..10),
    t=time_of_exposure_6,
    SEF=Slider(1, range=0..10))  # -> ErrorMessage, Utilization, Sigmafire, Width, Height, Geo; inputs CL: Curve
#   port Sigmafire: Flexural stress [MPa)
# ---------- beam_paramfire_sr: Python ----------
"""
Beam - Parametric fire with strength reduction method

    Args:
        CL: Center Line for column
        F: Vertical load,N, for the column to support (Calculated as a centrally placed load, also in the case when the column's center of gravity moves)
        Str: Strength class for the wood (C30, C24, C18, C14, GL32h, GL28h or GL24h) [Default: C24]
        Sup: Support conditions for the column (1=Simply supported both ends, 2=One end fixed and one end not supported, 3=One end fixed and one end simply supported, 4=Both ends fixed [Default: Simply supported]
        ToW: Type of Wood; Sawn, Planed or Glulam (Glued laminated timber) standard profiles.
        WidthProfile: Width of profile [mm] to calculate NRc,fire for. If no value is inserted, the NRc,fire is calculated on ToW.
        HeightProfile: Height of profile [mm] to calculate NRc,fire for. If no value is inserted, the NRc,fire is calculated on ToW.
        WS: Wood Species (1=Conifer p>290 kg/m3, 2=Laminated wood p>290 kg/m3 , 3=Hardwood p>450 kg/m3, 4=Plywood with a thickness d>20 mm and density p>450 kg/m3 [Default: Conifer]
        t: Time of exposure in minutes [Default: 60]
        SEF: Sides Exposed to Fire(1=Width, 2=Height, 3=Width+Height, 4=Width+2*Height, 5=2*Width+Height, 6=2*Width, 7=2*Height, 8=All [Default: Width+2*Height]
        O: Opening factor [m1/2] [Default: 0.4]
        q: Fireload [MJ/m2] [Default: 400]
        Ti: Thermal inertia [Default: 1160]
    Returns:
        NRc,fire: Charateristic resistance of the column after fire [kN]
        Width: Width of the cross section before fire
        Height: Height of the cross section before fire
        Geo: 3D model of the cross section
        Utilization: Utilization rate [%]
        ErrorMessage: Check this output for error messages
"""

import rhinoscriptsyntax as rs
import math as m

"""-------------------------------------------------------------------------"""
# USER INPUTS
StrDef = 'c24'
SupDef = 1
ToWDef = 'sawn'
WSDef = 1
tDef = 60
SEFDef = 4
ODef= 0.4
qDef = 400
TiDef = 1160

if not Str:
    Str=StrDef
if not Sup:
    Sup=SupDef
if not ToW:
    ToW=ToWDef
if not WS:
    WS=WSDef
if not t:
    t=tDef
if not SEF:
    SEF=SEFDef
if not O:
    O=ODef
if not q:
    q=qDef
if not Ti:
    Ti=TiDef

# Support conditions
L=rs.CurveLength(CL)
if Sup==1:
    Mmax=1/8*F*L**2
elif Sup==2:
    Mmax=1/2*F*L**2
elif Sup==3:
    Mmax=9/128*F*L**2
elif Sup==4:
    Mmax=1/8*F*L**2


# Strength class
if str.upper(Str)=='C30':
    fm=30
    fc=23
    E=8000
elif str.upper(Str)=='C24':
    fm=24
    fc=21
    E=7400
elif str.upper(Str)=='C18':
    fm=18
    fc=18
    E=6000
elif str.upper(Str)=='C14':
    fm=14
    fc=16
    E=4700
elif str.upper(Str)=='GL32H':
    fm=32
    fc=29
    E=11100
elif str.upper(Str)=='GL28H':
    fm=38
    fc=26.5
    E=10200
elif str.upper(Str)=='GL24H':
    fm=24
    fc=24
    E=9400

if WidthProfile>0 and HeightProfile>0:
    W=[WidthProfile]
    H=[HeightProfile]
    Input=0
elif str.lower(ToW)=='sawn':
    W=[50,38,50,50,75,50,50,63,50,50,100,50,75,75,75,125,75,100,150,100,175,200]
    H=[50,73,75,100,75,125,150,125,175,200,100,225,150,175,200,125,225,200,150,225,175,200]
    Input=1
elif str.lower(ToW)=='planed':
    W=[45,45,45,70,45,45,45,45,95,45,70,70,70,120,70,95,145,95,170,195]
    H=[45,70,95,70,120,145,170,195,95,220,145,170,195,120,220,195,145,220,170,195]
    Input=1
elif str.lower(ToW)=='glulam':
    w=[185,160,140,115,90,65,185,160,140,115,90,65,185,160,140,115,90,65,
    185,160,140,115,90,65,185,160,140,115,90,65,185,160,140,115,90,65,
    185,160,140,115,90,65,185,160,140,115,90,65,185,160,140,115,90,65,
    185,160,140,115,90,65,185,160,140,115,90,65,185,160,140,115,90,65,
    185,160,140,115,90,65,185,160,140,115,90,65,185,160,140,115,90,65,
    185,160,140,115,90,65,185,160,140,115,90,65,185,160,140,115,90,65,
    185,160,140,115,90,65,185,160,140,115,90,65,185,160,140,115,90,65,
    185,160,140,115,90,65,185,160,140,115,90,65,185,160,140,115,90,65,
    185,160,140,115,90,65,185,160,140,115,90,65,185,160,140,115,90,65,
    185,160,140,115,90,65,185,160,140,115,90,65,185,160,140,115,90,65,
    185,160,140,115,90,65,185,160,140,115,90,65,185,160,140,115,90,65,
    185,160,140,115,90,65,185,160,140,115,90,65,185,160,140,115,90,65,
    185,160,140,115,90,65,185,160,140,115,90,65,185,160,140,115,90,65,
    185,160,140,115,90,65,185,160,140,115,90,65,185,160,140,115,90,65,
    185,160,140,115,90,65]
    h=[100,100,100,100,100,100,133,133,133,133,133,133,167,167,167,167,167,167,
    200,200,200,200,200,200,233,233,233,233,233,233,267,267,267,267,267,267,
    300,300,300,300,300,300,333,333,333,333,333,333,367,367,367,367,367,367,
    400,400,400,400,400,400,433,433,433,433,433,433,467,467,467,467,467,467,
    500,500,500,500,500,500,533,533,533,533,533,533,567,567,567,567,567,567,
    600,600,600,600,600,600,633,633,633,633,633,633,667,667,667,667,667,667,
    700,700,700,700,700,700,733,733,733,733,733,733,767,767,767,767,767,767,
    800,800,800,800,800,800,833,833,833,833,833,833,867,867,867,867,867,867,
    900,900,900,900,900,900,933,933,933,933,933,933,967,967,967,967,967,967,
    1000,1000,1000,1000,1000,1000,1033,1033,1033,1033,1033,1033,1067,1067,1067,1067,1067,1067,
    1100,1100,1100,1100,1100,1100,1133,1133,1133,1133,1133,1133,1167,1167,1167,1167,1167,1167,
    1200,1200,1200,1200,1200,1200,1233,1233,1233,1233,1233,1233,1267,1267,1267,1267,1267,1267,
    1300,1300,1300,1300,1300,1300,1333,1333,1333,1333,1333,1333,1367,1367,1367,1367,1367,1367,
    1400,1400,1400,1400,1400,1400,1433,1433,1433,1433,1433,1433,1467,1467,1467,1467,1467,1467,
    1500,1500,1500,1500,1500,1500]
    A=[]
    for i in range(len(w)):
        A.append(w[i]*h[i]) 
    W = [x for _,x in sorted(zip(A,w))]
    H = [x for _,x in sorted(zip(A,h))]
    Input=1

#Wood species
if WS==1:
    Bn=0.65
elif WS==2:
    Bn=0.65
elif WS==3:
    Bn=0.5
elif WS==4:
    Bn=1
else:
    Bn=0.65

#Sides exposed to fire
SEF = m.ceil(SEF)
if SEF>8:
    SEF=8

"""-------------------------------------------------------------------------"""
# CALCULATION OF CROSS SECTION AFTER FIRE
#Maximum duration of fire
t1=0.0145*q/O
#Charring rate
BL=1.25-0.035/((1160/Ti)*O+0.021)
B1=1.5*Bn*BL
# Charring layer
if t<t1/3:
    dchar=B1*t
else:
    dchar=B1/(12*t1)*(-9*t**2+18*t1*t-t1**2)

# Cross section after fire
wr = [] 
hr = []
for i in range(len(W)):
    if SEF==1:
        wr.append(W[i])
        hr.append(H[i]-dchar)
    elif SEF==2:
        wr.append(W[i]-dchar)
        hr.append(H[i])
    elif SEF==3:
        wr.append(W[i]-dchar)
        hr.append(H[i]-dchar)
    elif SEF==4:
        wr.append(W[i]-2*dchar)
        hr.append(H[i]-dchar)
    elif SEF==5:
        wr.append(W[i]-dchar)
        hr.append(H[i]-2*dchar)
    elif SEF==6:
        wr.append(W[i])
        hr.append(H[i]-2*dchar)
    elif SEF==7:
        wr.append(W[i]-2*dchar)
        hr.append(H[i])
    elif SEF==8:
        wr.append(W[i]-2*dchar)
        hr.append(H[i]-2*dchar)

Wr = [] 
Hr = []
w = []
h = []
for i in range(len(wr)):
    if wr[i]>0 and hr[i]>0:
        Wr.append(wr[i])
        Hr.append(hr[i])
        w.append(W[i])
        h.append(H[i])

"""-------------------------------------------------------------------------"""
# Calculation of new moment of inertia
# Area of 1 corner
r = dchar
Acr = r**2*(1-m.pi/4)
# Moment of inertia corner
Ir = 0.00742*r**4
# Distance to center of gravity corner
sr = 0.223*r

Ar = []     #Area of cross section with rounded corners
S = []      #Static moment about original axis
Sh = []     #Static moment about original axis case 3
Sw = []     #Static moment about original axis case 3
drh = []     #Displacement of axis for corners
drw = []     #Displacement of axis for corners
Iysq = []   #Moment of inertia around z axis rectangle
Izsq = []   #Moment of inertia around y axis rectangle
Iycr = []   #Moment of inertia corner z axis corner
Izcr = []   #Moment of inertia corner y axis corner
Iytot = []  #Moment of inertia combined z axis total
Iztot = []  #Moment of inertia combined y axis total
Pr = []     #Perimeter


# Sides exposed to fire
# Width, Height, 2*Width, 2*Height same calculations
if SEF==1 or SEF==2 or SEF==6 or SEF== 7:  
    for i in range(len(Wr)):
        Iytot.append(1/12*Wr[i]*Hr[i]**3)
        Iztot.append(1/12*Hr[i]*Wr[i]**3)
        Pr.append(2*Wr[i]+2*Hr[i])
        Ar.append(Wr[i]*Hr[i])

# Width + Height
elif SEF==3:
    for i in range(len(Wr)):
        Ar.append((Wr[i]*Hr[i])-Acr)
        Sh.append(Acr*(Hr[i]/2-sr))
        drh.append(Sh[i]/Ar[i])
        Iysq.append(1/12*Wr[i]*(Hr[i]-2*drh[i])**3+1/12*Wr[i]*(2*drh[i])**3+Wr[i]*2*drh[i]*(Hr[i]/2)**2)
        Iycr.append(Ir+Acr*((Hr[i]/2)+drh[i]-sr)**2)
        Iytot.append(Iysq[i]-Iycr[i])
        Sw.append(Acr*(Wr[i]/2-sr))
        drw.append(Sw[i]/Ar[i])
        Izsq.append(1/12*Hr[i]*(Wr[i]-2*drh[i])**3+1/12*Hr[i]*(2*drh[i])**3+Hr[i]*2*drh[i]*(Wr[i]/2)**2)
        Izcr.append(Ir+Acr*((Wr[i]/2)+drw[i]-sr)**2)
        Iztot.append(Izsq[i]-Izcr[i])
        Pr.append(Hr[i]+(Hr[i]-r)+Wr[i]+(Wr[i]-r)+(m.pi*r*2)/4)

# Width + 2*Height 
elif SEF==4: 
    for i in range(len(Wr)):
        Ar.append(Wr[i]*Hr[i]-2*Acr)
        S.append(2*Acr*(Hr[i]/2-sr))
        drh.append(S[i]/Ar[i])
        Iysq.append(1/12*Wr[i]*(Hr[i]-2*drh[i])**3+1/12*Wr[i]*(2*drh[i])**3+Wr[i]*2*drh[i]*(Hr[i]/2)**2)
        Iycr.append(2*Ir+2*Acr*((Hr[i]/2)+drh[i]-sr)**2)
        Iytot.append(Iysq[i]-Iycr[i])
        Izsq.append((1/12*Hr[i]*Wr[i]**3))
        Izcr.append(2*Ir+2*Acr*((Wr[i]/2)-sr)**2)
        Iztot.append(Izsq[i]-Izcr[i])
        Pr.append((Wr[i])+2*(Hr[i]-r)+(Wr[i]-2*r)+(2*(m.pi*r*2)/4))

# 2*Width + Height
elif SEF==5:
    for i in range(len(Wr)):
        Ar.append(Hr[i]*Wr[i]-2*Acr)
        S.append(2*Acr*(Wr[i]/2-sr))
        drw.append(S[i]/Ar[i])
        Iysq.append(1/12*Hr[i]*(Wr[i]-2*drw[i])**3+1/12*Hr[i]*(2*drw[i])**3+Hr[i]*2*drw[i]*(Wr[i]/2)**2)
        Iycr.append(2*Ir+2*Acr*((Wr[i]/2)+drw[i]-sr)**2)
        Iytot.append(Iysq[i]-Iycr[i])
        Izsq.append((1/12*Wr[i]*Hr[i]**3))
        Izcr.append(2*Ir+2*Acr*((Hr[i]/2)-sr)**2)
        Iztot.append(Izsq[i]-Izcr[i])
        Pr.append((Hr[i]+2*(Wr[i]-r)+(Hr[i]-2*r)+(2*(m.pi*r*2)/4)))

# 2*Width + 2*Height
elif SEF==8: 
    for i in range(len(Wr)):
        Ar.append(Wr[i]*Hr[i]-4*Acr)
        Iytot.append(1/12*Wr[i]*Hr[i]**3-r**2*(4-m.pi)*(Hr[i]/2-sr)**2-4*Ir)
        Iztot.append(1/12*Hr[i]*Wr[i]**3-r**2*(4-m.pi)*(Wr[i]/2-sr)**2-4*Ir)
        Pr.append(2*(Hr[i]-2*r)+2*(Wr[i]-2*r)+m.pi*r*2)

else:
    print('You are doing something wrong')
Iy=Iytot
Iz=Iztot

"""-------------------------------------------------------------------------"""
# Verification of wooden beam 
sigmafire = []
for i in range(len(Wr)):
    sigmafire.append(Mmax/Iy[i]*Hr[i]/2)

if Input==0:
    if 0<sigmafire[i]<fm:
       Width = WidthProfile
       Height = HeightProfile
       Sigmafire = sigmafire[0]
       Utilization = Sigmafire/fm*100
    else:
        ErrorMessage='No profiles with selected citeria can support the load'
else:
    # Selecting the smallest profile with capability to support the load
    Wi = []
    He = []
    fmfire = []
    for i in range(len(Wr)):
        if 0<sigmafire[i]<fm:
            Wi.append(w[i])
            He.append(h[i])
            fmfire.append(sigmafire[i])
    if len(Wi)>0:
        Width = Wi[0]
        Height = He[0]
        Sigmafire = fmfire[0]
        Utilization = Sigmafire/fm*100
    else:
        ErrorMessage='No profiles with selected citeria can support the load'



"""-------------------------------------------------------------------------"""
# 3D model for "baking"
if Sigmafire>fm:
    End = rs.CurveEndPoint(CL)
    Start = rs.CurveStartPoint(CL)
    Vector = rs.VectorAdd(Start,End)
    Plane = rs.PlaneFromNormal(Start,Vector)
    CrossSection = rs.AddRectangle(Plane, Height, Width)
    #Translation vector center
    Vec1 =rs.VectorAdd([0,0,0],[-Width/2,0,-Height/2])
    Geo = rs.MoveObject(rs.ExtrudeCurve(CrossSection,CL),Vec1)
    rs.CapPlanarHoles(Geo)
# ---------- end beam_paramfire_sr ----------
panel_18 = Panel(column_paramfire_sr.Utilization)
panel_19 = Panel(column_paramfire_sr.NRcfire)
panel_20 = Panel(column_paramfire_sr.Width)
panel_21 = Panel(column_paramfire_sr.Height)
panel_22 = Panel(beam_paramfire_sr.Height)
panel_23 = Panel(beam_paramfire_sr.Utilization)
panel_24 = Panel(beam_paramfire_sr.Width)

# ---- group: Support conditions column
list = ValueList({"Simply supported both ends": 1, "One end fixed and one end not supported": 2, "One end fixed and one end simply supported": 0.699, "Both ends fixed": 1/2}, selected="Simply supported both ends")

# ---- group: Strength class wood
strength_class_for_wood = ValueList({"C30": 30, "C24": 24, "C18": 18, "C14": 14, "GL32": 32, "Gl28": 28, "GL24": 24}, selected="C24")

# ----
# "Calculation of minimum required cross section of wooden columns"
# 
# "2017"
# 
# Created by Mikkel Dohm Andersen
load_in_n = Slider(274, range=0..1000)
pt_13 = ConstructPoint(XCoordinate=0, YCoordinate=0, ZCoordinate=0)
pt_14 = ConstructPoint(XCoordinate=0, YCoordinate=0, ZCoordinate=Slider(3000, range=0..10000))
time_of_exposure_7 = Slider(27, range=0..100)
ln_7 = Line(StartPoint=pt_13, EndPoint=pt_14)
type_of_wood = Data(Tree({0;0}: ["50", "38", "50", "50", "75", "50", "50", "63", "50", "50", "100", "50", "75", "75", "75", "125", "75", "100", "150", "100", "175", "200"], {0;1}: ["50", "73", "75", "100", "75", "125", "150", "125", "175", "200", "100", "225", "150", "175", "200", "125", "225", "200", "150", "225", "175", "200"], {0;2}: ["2.5", "2.77", "3.75", "5", "5.62", "6.25", "7.5", "7.87", "8.75", "10", "10", "11.25", "11.25", "13.15", "15", "15.65", "16.9", "20", "22.5", "22.5", "30.6", "40"], {0;3}: ["20.8", "33.8", "46.9", "83.3", "70.3", "130", "187.5", "164", "255", "333", "166.5", "422", "281", "383", "500", "326", "633", "667", "563", "844", "893", "1335"], {0;4}: ["20.8", "17.57", "31.3", "41.7", "70.3", "52.1", "62.5", "82.7", "72.9", "83.3", "166.5", "93.8", "140.5", "164", "187.5", "326", "211", "333", "563", "375", "893", "1335"], {0;5}: ["0.521", "1.232", "1.760", "4.17", "2.64", "8.14", "14.05", "10.25", "22.3", "33.3", "8.33", "47.5", "21.1", "33.5", "50", "20.3", "71.2", "66.7", "42.2", "94.9", "78.2", "133.5"], {0;6}: ["0.521", "0.334", "0.781", "1.04", "2.64", "1.3", "1.56", "2.6", "1.825", "2.08", "8.33", "2.34", "5.27", "6.15", "7.03", "20.3", "7.91", "16.65", "42.2", "18.75", "78.2", "133.5"]))
monodimensional_charring_rates = ValueList({"Conifer with p > 290 kg/m3": 0.65, "Laminated wood with p > 290 kg/m3": 0.65, "Hardwood with p > 450 kg/m3": 0.50, "Plywood with a thickness d > 20 mm and density p > 450 kg/m3": 1}, selected="Conifer with p > 290 kg/m3")

# ---- group: Calculate required moment of inertia python
calculate_required_moment_of_inertia = PythonScript(Ncr=load_in_n, E=strength_class_for_wood, SupCon=list, CL=ln_7)  # -> out, ls, I
# ---------- calculate_required_moment_of_inertia: Python ----------
import math as m
import rhinoscriptsyntax as rs

ls = rs.CurveLength(CL)*SupCon
I = (m.pow(ls,2)*Ncr)/(m.pow(m.pi,2)*E)
# ---------- end calculate_required_moment_of_inertia ----------

# ----
monodimensional_charring_rates_2 = ValueList({"Conifer with p > 290 kg/m3": 0.65, "Laminated wood with p > 290 kg/m3": 0.65, "Hardwood with p > 450 kg/m3": 0.50, "Plywood with a thickness d > 20 mm and density p > 450 kg/m3": 1}, selected="Conifer with p > 290 kg/m3")
fire_exposed_sides_of_cross_section = ValueList({"Width": 1, "Height": 2, "Width + Height": 3, "Width + 2*Height": 4, "2*Width + Height": 5, "2*Width": 6, "2*Height": 7, "All": 8}, selected="Width + 2*Height")
time_of_exposure_8 = Data(time_of_exposure_7)
critical_column_length = Data(calculate_required_moment_of_inertia.ls)

# ---- group: Wood species charring rate
notional_charring_rates = ValueList({"Conifer with p > 290 kg/m3": 0.8, "Laminated wood with p > 290 kg/m3": 0.7, "Hardwood with p > 450 kg/m3": 0.55}, selected="Conifer with p > 290 kg/m3")

# ---- group: Calculate required moment of inertia expression
beregning_af_inertimoment_expression = BeregningAfInertimomentExpression(load=load_in_n, strength_class_wood=strength_class_for_wood, support_conditions=list, centerline_for_column=ln_7)  # disabled

# ----
fire_exposed_sides_of_cross_section_2 = ValueList({"Width": 1, "Height": 2, "Width + Height": 3, "Width + 2*Height": 4, "2*Width + Height": 5, "2*Width": 6, "2*Height": 7, "All": 8}, selected="Width + 2*Height")
fire_exposed_sides_of_cross_section_3 = ValueList({"Width": 1, "Height": 2, "Width + Height": 3, "Width + 2*Height": 4, "2*Width + Height": 5, "All": 6, "2*Width": 7, "2*Height": 8}, selected="Width")
time_of_exposure_9 = Slider(12, range=0..100)
panel_25 = Panel(calculate_required_moment_of_inertia.I)

# ---- group: Calculate required moment of inertia components
beregning_af_inertimoment_med_komponente = BeregningAfInertimomentMedKomponenter()  # "Beregning af inertimoment med komponenter"; disabled

# ----
time_of_exposure_10 = Data(time_of_exposure_7)
type_of_wood_2 = Data(type_of_wood)
type_of_wood_3 = Data(type_of_wood_2)
type_of_wood_4 = Data(type_of_wood_3)
requried_moment_of_inertia = Data(calculate_required_moment_of_inertia.I)

# ----
# Deconstruct cross section data
type_of_wood_5 = Data(type_of_wood_2)
flip = FlipMatrix(Data=type_of_wood_5)
item = ListItem(List=flip, Index=0, Wrap=True)  # -> flatten(Item), flatten(Item1), flatten(Item2), flatten(Item3), flatten(Item4), flatten(Item5), flatten(Item6)
wy = Data(item.Item3)
wz = Data(item.Item4)
iy = Data(item.Item5)
width = Data(item.Item)
area = Data(item.Item2)
iz = Data(item.Item6)
height = Data(item.Item1)

charring_rate = Data(monodimensional_charring_rates)
time_of_exposure_11 = Data(time_of_exposure_10)

# ----
# Deconstruct cross section data
type_of_wood_6 = Data(type_of_wood_4)
flip_2 = FlipMatrix(Data=type_of_wood_6)
item_2 = ListItem(List=flip_2, Index=0, Wrap=True)  # -> flatten(Item), flatten(Item1), flatten(Item2), flatten(Item3), flatten(Item4), flatten(Item5), flatten(Item6)
iy_2 = Data(item_2.Item5)
width_2 = Data(item_2.Item)
area_2 = Data(item_2.Item2)
wy_2 = Data(item_2.Item3)
wz_2 = Data(item_2.Item4)
iz_2 = Data(item_2.Item6)
height_2 = Data(item_2.Item1)

# ----
# Deconstruct cross section data
type_of_wood_7 = Data(type_of_wood_3)
flip_3 = FlipMatrix(Data=type_of_wood_7)
item_3 = ListItem(List=flip_3, Index=0, Wrap=True)  # -> flatten(Item), flatten(Item1), flatten(Item2), flatten(Item3), flatten(Item4), flatten(Item5), flatten(Item6)
wy_3 = Data(item_3.Item3)
wz_3 = Data(item_3.Item4)
iy_3 = Data(item_3.Item5)
width_3 = Data(item_3.Item)
area_3 = Data(item_3.Item2)
iz_3 = Data(item_3.Item6)
height_3 = Data(item_3.Item1)

# ----
# Standard fire design
# Strength reduction method
multiplication = Multiplication(A=charring_rate, B=time_of_exposure_11)
charring_depth = Data(multiplication)

# ---- group: Check for bmin
python = PythonScript(dchar=charring_depth, z=fire_exposed_sides_of_cross_section_2)  # -> out, bmin
# ---------- python: Python ----------
if z==1 or z==2 or z==3 or z==5 or z==6:
    a=1
else:
    a=2

if dchar < 13:
    bmin = 8.15*dchar
else:
    bmin = a*dchar+80

print(bmin)
# ---------- end python ----------

# ----
larger = LargerThan(FirstNumber=width_3, SecondNumber=python.bmin)  # -> LargerThan, OrEqualTo
cull = CullPattern(List=width_3, CullPattern=larger.LargerThan)
cull_2 = CullPattern(List=height_3, CullPattern=larger.LargerThan)
cull_3 = CullPattern(List=area_3, CullPattern=larger.LargerThan)
width_larger_than_bmin = Data(cull)
height_larger_than_bmin = Data(cull_2)
area_larger_than_bmin = Data(cull_3)
dchar = Data(charring_depth)
fire_exposed_sides = Data(fire_exposed_sides_of_cross_section_2)

# ---- group: Generates reduced width and height
# Calculates moment of inertia
python_2 = PythonScript(W=width_larger_than_bmin, H=height_larger_than_bmin, d=dchar, z=fire_exposed_sides)  # -> out, Width, Height; inputs W: list, H: list
# ---------- python_2: Python ----------
w=[]
h=[]

for i in range(len(W)):
    if z==1:
        w.append(W[i])
        h.append(H[i]-d)
        #print('z 1')
    elif z==2:
        w.append(W[i]-d)
        h.append(H[i])
        #print('z 2')
    elif z==3:
        w.append(W[i]-d)
        h.append(H[i]-d)
        #print('z 2')
    elif z==4:
        w.append(W[i]-2*d)
        h.append(H[i]-d)
        #print('z 4')
    elif z==5:
        w.append(W[i]-d)
        h.append(H[i]-2*d)
        #print('z 5')
    elif z==6:
        w.append(W[i])
        h.append(H[i]-2*d)
        #print('z 6')
    elif z==7:
        w.append(W[i]-2*d)
        h.append(H[i])
        #print('z 7')
    elif z==8:
        w.append(W[i]-2*d)
        h.append(H[i]-2*d)
        #print('z 8')
Width=w
Height=h
# ---------- end python_2 ----------

# ---- group: Uses reduced widht and height to calculate moment of inertia
python_3 = PythonScript(r=charring_depth, W=python_2.Width, H=python_2.Height, z=fire_exposed_sides)  # -> out, Iy, Iz, Pr, Ar; inputs W: list, H: list
# ---------- python_3: Python ----------
import math as m
#Area of 1 corner
Acr = r**2*(1-m.pi/4)
#Moment of inertia corner
Ir = 0.00742*r**4
#Distance to center of gravity corner
sr = 0.223*r

#Lists for calculation
A = []      #Cross section area
S = []      #Static moment about original axis
Sh = []     #Static moment about original axis case 3
Sw = []     #Static moment about original axis case 3
dr = []     #Displacement of axis for corners
Iysq = []   #Moment of inertia around z axis rectangle
Izsq = []   #Moment of inertia around y axis rectangle
Iycr = []   #Moment of inertia corner z axis corner
Izcr = []   #Moment of inertia corner y axis corner
Iytot = []  #Moment of inertia combined z axis total
Iztot = []  #Moment of inertia combined y axis total
Pr = []     #Perimeter
Ar = []     #Area of cross section with rounded corners

#Sides exposed to fire
#Width, Height, 2*Width, 2*Height same calculations
if z==1 or z==2 or z==6 or z== 7:  
    for i in range(len(W)):
        Iytot.append(1/12*W[i]*H[i]**3)
        Iztot.append(1/12*H[i]*W[i]**3)
        Pr.append(2*W[i]+2*H[i])
        Ar.append(W[i]*H[i])
#Width + Height
elif z==3:
    for i in range(len(W)):
        A.append(W[i]*H[i]-Acr)
        Sh.append(Acr*(H[i]/2-sr))
        drh.append(Sh[i]/A[i])
        Iysq.append(1/12*W[i]*(H[i]-2*drh[i])**3+1/12*W[i]*(2*drh[i])**3+W[i]*2*drh[i]*(H[i]/2)**2)
        Iycr.append(Ir+Acr*((H[i]/2)+drh[i]-sr)**2)
        Iytot.append(Iysq[i]-Iycr[i])
        Sw.append(Acr*(W[i]/2-sr))
        drw.append(Sw[i]/A[i])
        Izsq.append(1/12*H[i]*(W[i]-2*drh[i])**3+1/12*H[i]*(2*drh[i])**3+H[i]*2*drh[i]*(W[i]/2)**2)
        Iycr.append(Ir+Acr*((W[i]/2)+drw[i]-sr)**2)
        Iztot.append(Izsq[i]-Izcr[i])
        Pr.append(H[i]+(H[i]-r)+W[i]+(W[i]-r)+(m.pi*r*2)/4)
        Ar.append(H[i]*W[i]-Acr)
#Width + 2*Height 
elif z==4: 
    for i in range(len(W)):
        A.append(W[i]*H[i]-2*Acr)
        S.append(2*Acr*(H[i]/2-sr))
        dr.append(S[i]/A[i])
        Iysq.append(1/12*W[i]*(H[i]-2*dr[i])**3+1/12*W[i]*(2*dr[i])**3+W[i]*2*dr[i]*(H[i]/2)**2)
        Iycr.append(2*Ir+2*Acr*((H[i]/2)+dr[i]-0.223*r)**2)
        Iytot.append(Iysq[i]-Iycr[i])
        Izsq.append((1/12*H[i]*W[i]**3))
        Izcr.append(2*Ir+2*Acr*((W[i]/2)-0.223*r)**2)
        Iztot.append(Izsq[i]-Izcr[i])
        Pr.append((W[i])+2*(H[i]-r)+(W[i]-2*r)+(2*(m.pi*r*2)/4))
        Ar.append(W[i]*H[i]-2*Acr)
#2*Width + Height
elif z==5:
    for i in range(len(W)):
        A.append(H[i]*W[i]-2*Acr)
        S.append(2*Acr*(W[i]/2-sr))
        dr.append(S[i]/A[i])
        Iysq.append(1/12*H[i]*(W[i]-2*dr[i])**3+1/12*H[i]*(2*dr[i])**3+H[i]*2*dr[i]*(W[i]/2)**2)
        Iycr.append(2*Ir+2*Acr*((W[i]/2)+dr[i]-0.223*r)**2)
        Iytot.append(Iysq-Iycr)
        Izsq.append((1/12*W[i]*H[i]**3))
        Izcr.append(2*Ir+2*Acr*((H[i]/2)-0.223*r)**2)
        Iztot.append(Izsq-Izcr)
        Pr.append((H[i]+2*(W[i]-r)+(H[i]-2*r)+(2*(m.pi*r*2)/4)))
        Ar.append(H[i]*W[i]-2*Acr)
#2*Width + 2*Height
elif z==8: 
    for i in range(len(W)):
        Iytot.append(1/12*W[i]*H[i]**3-r**2*(4-m.pi)*(H[i]/2-sr)**2-4*Ir)
        Iztot.append(1/12*H[i]*W[i]**3-r**2*(4-m.pi)*(W[i]/2-sr)**2-4*Ir)
        Pr.append(2*(H[i]-2*r)+2*(W[i]-2*r)+m.pi*r*2)
        Ar.append(W[i]*H[i]-4*Acr)
else:
    print('You are doing something wrong')
Iy=Iytot
Iz=Iztot
# ---------- end python_3 ----------

# ----
time_of_exposure_12 = Data(time_of_exposure_11)
e_modulus_e0 = Panel("7400")
fc = Panel("24")

# ---- group: Strength and stiffnes reduction factor
kmod_fire = PythonScript(t=time_of_exposure_12, Pr=python_3.Pr, Ar=python_3.Ar)  # -> out, Compression, Flexural, TensileShear; inputs Pr: list, Ar: list
# ---------- kmod_fire: Python ----------
C =[]
F = []
TS = []

for i in range(len(Pr)):
    if t<20:
        C.append(1-1/125*Pr[i]/Ar[i]*t/20)
        F.append(1-1/200*Pr[i]/Ar[i]*t/20)
        TS.append(1-1/330*Pr[i]/Ar[i]*t/20)
    else:
        C.append(1-1/125*Pr[i]/Ar[i])
        F.append(1-1/200*Pr[i]/Ar[i])
        TS.append(1-1/330*Pr[i]/Ar[i])
        
Compression = C
Flexural = F
TensileShear = TS
# ---------- end kmod_fire ----------

# ----
bc = Panel("0.2")
iy_4 = Data(python_3.Iy)
iz_4 = Data(python_3.Iz)
e_modulus_e0_2 = Panel("7400")
fc_2 = Panel("24")
bc_2 = Panel("0.2")
python_4 = PythonScript()  # -> Out, A

# ---- group: TEST FOR CALCULATION OF MOMENT OF INERTIA
number_slider_3 = Slider(93, range=0..1000)  # disabled
number_slider_4 = Slider(39, range=0..100)  # disabled
number_slider_5 = Slider(112, range=0..1000)  # disabled
int = Integer(number_slider_3)  # disabled
int_2 = Integer(number_slider_5)  # disabled
int_3 = Integer(number_slider_4)  # disabled

# ----
width_mm = Panel("""50
38
50
50
75
50
50
63
50
50
100
50
75
75
75
125
75
100
150
100
175
200""")
data = Data(width_mm)
panel_26 = Panel("Savskåret træ")
height_mm = Panel("""50
73
75
100
75
125
150
125
175
200
100
225
150
175
200
125
225
200
150
225
175
200""")
data_2 = Data(height_mm)
area_10_3_mm2 = Panel("""2.5
2.77
3.75
5
5.62
6.25
7.5
7.87
8.75
10
10
11.25
11.25
13.15
15
15.65
16.9
20
22.5
22.5
30.6
40""")
data_3 = Data(area_10_3_mm2)
wy_10_3_mm_3 = Panel("""20.8
33.8
46.9
83.3
70.3
130
187.5
164
255
333
166.5
422
281
383
500
326
633
667
563
844
893
1335""")
data_4 = Data(wy_10_3_mm_3)
wz_10_3_mm_3 = Panel("""20.8
17.57
31.3
41.7
70.3
52.1
62.5
82.7
72.9
83.3
166.5
93.8
140.5
164
187.5
326
211
333
563
375
893
1335""")
data_5 = Data(wz_10_3_mm_3)
iy_10_6_mm_4 = Panel("""0.521
1.232
1.760
4.17
2.64
8.14
14.05
10.25
22.3
33.3
8.33
47.5
21.1
33.5
50
20.3
71.2
66.7
42.2
94.9
78.2
133.5""")
data_6 = Data(iy_10_6_mm_4)
iz_10_6_mm_4 = Panel("""0.521
0.334
0.781
1.04
2.64
1.3
1.56
2.6
1.825
2.08
8.33
2.34
5.27
6.15
7.03
20.3
7.91
16.65
42.2
18.75
78.2
133.5""")
data_7 = Data(iz_10_6_mm_4)
entwine = Entwine(
    Branch00=data,
    Branch01=data_2,
    Branch02=data_3,
    Branch03=data_4,
    Branch04=data_5,
    Branch05=data_6,
    Branch06=data_7,
    FlattenInputs=True)
data_8 = Data(entwine)

# ---- group: TEST FOR CALCULATION OF MOMENT OF INERTIA / Test for case 2*width + height
python_5 = PythonScript(r=int_3, H=int, W=int_2)  # -> out, a; disabled
# ---------- python_5: Python ----------
import math as m
#Area of 1 corner
Acr = r**2*(1-m.pi/4)
#Moment of inertia corner
Ir = 0.00742*r**4
#Distance to center of gravity corner
sr = 0.223*r
#Width + 2Height 


A=(W*H-Acr)
Sh=(Acr*(H/2-sr))
drh=(Sh/A)
Iysq=(1/12*W*(H-2*drh)**3+1/12*W*(2*drh)**3+W*2*drh*(H/2)**2)
Iycr=(Ir+Acr*((H/2)+drh-sr)**2)
Iytot=(Iysq-Iycr)
Sw=(Acr*(W/2-sr))
drw=(Sw/A)
Izsq=(1/12*H*(W-2*drh)**3+1/12*H*(2*drh)**3+H*2*drh*(W/2)**2)
Iycr=(Ir+Acr*((W/2)+drw-sr)**2)
Iztot=(Izsq-Izcr)
Pr=(H+(H-r)+W+(W-r)+(m.pi*r*2)/4)
Ar=(H*W-Acr)

"""
#NIX PILLE!!!
A=(W*H-2*Acr)
S=(2*Acr*(H/2-sr))
dr=(S/A)
Iysq=(1/12*W*(H-2*dr)**3+1/12*W*(2*dr)**3+W*2*dr*(H/2)**2)
Iycr=(2*Ir+2*Acr*((H/2)+dr-0.223*r)**2)
Iytot=(Iysq-Iycr)
Izsq=((1/12*H*W**3))
Izcr=(2*Ir+2*Acr*((W/2)-0.223*r)**2)
Iztot=(Izsq-Izcr)
Pr=(2*(W-2*r)+(H-2*r)+(H-4*r)+(2*(m.pi*r*2)/4))
Ar=(W*H-2*Acr)
"""
print(Iytot)
print(Iztot)
# ---------- end python_5 ----------

# ----
# Standard fire design
# Reduced Cross Section Method
time_of_exposure_13 = Data(time_of_exposure_9)
num = Number(area)
num_2 = Number(width)
num_3 = Number(height)
num_4 = Number(num)

abs = Absolute(Value=time_of_exposure_13)
pyrolysis_zone = PythonScript(t=abs)  # -> out, dpy
# ---------- pyrolysis_zone: Python ----------
if t<20: 
    dpy = 7/20*t 
else:
    dpy = 7

print(dpy)
# ---------- end pyrolysis_zone ----------
panel_27 = Panel("Pyrolysis Zone")
pyrolysis_zone_2 = Data(pyrolysis_zone.dpy)

charring_rate_2 = Data(notional_charring_rates)
panel_28 = Panel("Charring Layer")
expression = Expression(B=charring_rate_2, t=time_of_exposure_13, Expression="B*t")
charring_layer = Data(expression)

# ----
# Parametric fire design
# Strength reduction method
time_of_exposure_14 = Data(time_of_exposure_8)
opening_factor = Data(Slider(0.04, range=0..0.1))
fire_load_density = Data(Slider(400, range=0..1000))
charring_rate_3 = Data(monodimensional_charring_rates_2)
thermal_inertia = Data(Slider(1160, range=0..10000))
fire_exposed_sides_2 = Data(fire_exposed_sides_of_cross_section)
time_of_exposure_15 = Data(time_of_exposure_14)

# ---- group: Charring depth in parametric fires
python_6 = PythonScript(t=time_of_exposure_14, O=opening_factor, q=fire_load_density, b=thermal_inertia, B0=charring_rate_3)  # -> out, dchar
# ---------- python_6: Python ----------
t1=0.0145*q/O
BL=1.25-0.035/((1160/b)*O+0.021)
B1=1.5*B0*BL
if t<t1/3:
    dchar=B1*t
elif t1/3<t:
    dchar=B1/(12*t1)*(-9*t**2+18*t1*t-t1**2)
# ---------- end python_6 ----------

# ---- group: Smallest profile with enough capacity
requried_moment_of_inertia_2 = Data(requried_moment_of_inertia)
type_of_wood_8 = Data(type_of_wood)

# ---- group: Smallest profile with enough capacity / Cross section dimensions
flip_4 = FlipMatrix(Data=type_of_wood_8)
item_4 = ListItem(List=flip_4, Index=0, Wrap=True)  # -> flatten(Item), flatten(Item1), flatten(Item2), flatten(Item3), flatten(Item4), flatten(Item5), flatten(Item6)
width_4 = Data(item_4.Item)
area_4 = Data(item_4.Item2)
wy_4 = Data(item_4.Item3)
wz_4 = Data(item_4.Item4)
iy_5 = Data(item_4.Item5)
iz_5 = Data(item_4.Item6)
height_4 = Data(item_4.Item1)

# ---- group: Smallest profile with enough capacity (continued)
iy_6 = Data(iy_5)
iz_6 = Data(iz_5)
python_7 = PythonScript(I=requried_moment_of_inertia_2, Iy=iy_6, Iz=iz_6)  # -> out, PatternY, PatternZ; inputs Iy: list, Iz: list
# ---------- python_7: Python ----------
""" Returns member boolean statement indicating moments of inertia larger than needed

    Args:
        I: Moment of inertia needed
        Iy: Moment of inertia y-axiz
        Iz: Moment of inertia z-axiz
    Returns:
        PatternY: Boolean statement for capacity > needed for y axis
        PatternZ: Boolean statement for capacity > needed for z axis
"""
Y=[]
Z=[]

# Muliplying the list values to match input for Iy
for i in Iy:
    Y.append(i*10**6)
for i in Iz:
    Z.append(i*10**6)
#print (y)

#Empty list for the new values
PatternY=[]
PatternZ=[]
#Creating boolean statement for capacity > needed
for i in Y:
    PatternY.append(i>I)
#print(PatternY)
for i in Z:
    PatternZ.append(i>I)
#print(PatternZ)
str(PatternY)
str(PatternZ)
# ---------- end python_7 ----------
python_8 = PythonScript(x=python_7.PatternY, y=python_7.PatternZ)  # -> out, True, False; inputs x: list, y: list; same code as python_2
cull_4 = CullPattern(List=area_4, CullPattern=python_8.True)
bnd = Bounds(Numbers=cull_4)
num_5 = Number(area_4)
dedomain = DeconstructDomain(Domain=bnd)  # -> Start, End
mindex = MemberIndex(Set=num_5, Member=dedomain.Start)  # -> Index, Count
num_6 = Number(num_5)
num_7 = Number(width_4)
num_8 = Number(height_4)
bnd_2 = Bounds(Numbers=mindex.Index)
bnd_3 = Bounds(Numbers=cull_4)
dedomain_2 = DeconstructDomain(Domain=bnd_2)  # -> Start, End
dedomain_3 = DeconstructDomain(Domain=bnd_3)  # -> Start, End
item_5 = ListItem(List=num_6, Index=dedomain_2.Start, Wrap=True)
item_6 = ListItem(List=num_8, Index=dedomain_2.Start, Wrap=True)
item_7 = ListItem(List=num_7, Index=dedomain_2.Start, Wrap=True)
width_5 = Data(item_7)
height_5 = Data(item_6)
width_6 = Data(width_5)
height_6 = Data(height_5)

# ----
addition = Addition(A=charring_layer, B=pyrolysis_zone_2)
carring_layer_pyrolysis_zone = Data(addition)

panel_29 = Panel("Exposed sides")
python_9 = PythonScript(W=width, H=height, d=carring_layer_pyrolysis_zone, z=fire_exposed_sides_of_cross_section_3)  # -> out, Width, Height; inputs W: list, H: list
# ---------- python_9: Python ----------
w=[]
h=[]
for i in range(len(W)):
    if z==1:
        w.append(W[i])
        h.append(H[i]-d)
        #print('z 1')
    elif z==2:
        w.append(W[i]-d)
        h.append(H[i])
        #print('z 2')
    elif z==3:
        w.append(W[i]-d)
        h.append(H[i]-d)
        #print('z 2')
    elif z==4:
        w.append(W[i]-2*d)
        h.append(H[i]-d)
        #print('z 4')
    elif z==5:
        w.append(W[i]-d)
        h.append(H[i]-2*d)
        #print('z 5')
    elif z==6:
        w.append(W[i])
        h.append(H[i]-2*d)
        #print('z 6')
    elif z==7:
        w.append(W[i]-2*d)
        h.append(H[i])
        #print('z 7')
    elif z==8:
        w.append(W[i]-2*d)
        h.append(H[i]-2*d)
        #print('z 8')
Width=w
Height=h
# ---------- end python_9 ----------

# ---- group: Iz
iy_7 = Expression(W=python_9.Width, H=python_9.Height, Expression="1/12*H*W^3")

# ----
panel_30 = Panel(python_9.Width)
iy_8 = Expression(W=python_9.Width, H=python_9.Height, Expression="1/12*W*H^3")
panel_31 = Panel(python_9.Height)
iy_9 = Data(iy_8)
iz_7 = Data(iy_7)
python_10 = PythonScript(I=requried_moment_of_inertia_2, Iy=iy_9, Iz=iz_7)  # -> out, PatternY, PatternZ; inputs Iy: list, Iz: list; same code as python
python_11 = PythonScript(x=python_10.PatternY, y=python_10.PatternZ)  # -> out, True, False; inputs x: list, y: list; same code as python_2
cull_5 = CullPattern(List=area, CullPattern=python_11.True)
bnd_4 = Bounds(Numbers=cull_5)
dedomain_4 = DeconstructDomain(Domain=bnd_4)  # -> Start, End
mindex_2 = MemberIndex(Set=num, Member=dedomain_4.Start)  # -> Index, Count
bnd_5 = Bounds(Numbers=mindex_2.Index)
dedomain_5 = DeconstructDomain(Domain=bnd_5)  # -> Start, End
item_8 = ListItem(List=num_4, Index=dedomain_5.Start, Wrap=True)
item_9 = ListItem(List=num_3, Index=dedomain_5.Start, Wrap=True)
item_10 = ListItem(List=num_2, Index=dedomain_5.Start, Wrap=True)
width_7 = Data(item_10)
height_7 = Data(item_9)
width_8 = Data(width_7)
height_8 = Data(height_7)

cluster = Cluster(
    width_catalog=width,
    height_catalog=height,
    area=area,
    required_moment_of_inertia=requried_moment_of_inertia_2,
    iy=iy_9,
    iz=iz_7)  # -> width_3, height_3

charring_depth_2 = Data(python_6.dchar)
dchar_2 = Data(charring_depth_2)

# ---- group: Check for bmin
python_12 = PythonScript(dchar=charring_depth_2, z=fire_exposed_sides_of_cross_section)  # -> out, bmin; same code as python

# ----
larger_2 = LargerThan(FirstNumber=width_2, SecondNumber=python_12.bmin)  # -> LargerThan, OrEqualTo
cull_6 = CullPattern(List=width_2, CullPattern=larger_2.LargerThan)
cull_7 = CullPattern(List=height_2, CullPattern=larger_2.LargerThan)
cull_8 = CullPattern(List=area_2, CullPattern=larger_2.LargerThan)
width_larger_than_bmin_2 = Data(cull_6)
height_larger_than_bmin_2 = Data(cull_7)
area_larger_than_bmin_2 = Data(cull_8)

# ---- group: Generates reduced width and height
# Calculates moment of inertia
python_13 = PythonScript(W=width_larger_than_bmin_2, H=height_larger_than_bmin_2, d=dchar_2, z=fire_exposed_sides_2)  # -> out, Width, Height; inputs W: list, H: list; same code as python_2

# ---- group: Uses reduced widht and height to calculate moment of inertia
python_14 = PythonScript(r=charring_depth_2, W=python_13.Width, H=python_13.Height, z=fire_exposed_sides_2)  # -> out, Iy, Iz, Pr, Ar; inputs W: list, H: list; same code as python_3

# ---- group: Strength and stiffnes reduction factor
kmod_fire_2 = PythonScript(t=time_of_exposure_15, Pr=python_14.Pr, Ar=python_14.Ar)  # -> out, Compression, Flexural, TensileShear; inputs Pr: list, Ar: list; same code as kmod_fire

# ----
iy_10 = Data(python_14.Iy)
iz_8 = Data(python_14.Iz)

# ---- group: Verification of columns
python_15 = PythonScript(
    ls=critical_column_length,
    W=python_13.Width,
    H=python_13.Height,
    Ar=python_14.Ar,
    Iy=iy_10,
    Iz=iz_8,
    E=e_modulus_e0,
    EF=kmod_fire_2.Flexural,
    EC=kmod_fire_2.Compression,
    fc=fc,
    Bc=bc)  # -> out, a; inputs W: list, H: list, Ar: list, Iy: list, Iz: list, EF: list, EC: list
# ---------- python_15: Python ----------
#Verification of wooden column
import math as m

lambdaY = []
SigmaE = []  
kE = []  
lambdarel = [] 
kfire = []
kc = []
NRcfire = []

for i in range(len(W)):
    #Slenderness ratio
    lambdaY.append(ls/m.sqrt(Iy[i]/Ar[i]))
    #Euler stress
    SigmaE.append(m.pi**2*(E*EF[i])/lambdaY[i]**2)
    #Euler factor
    kE.append(SigmaE[i]/(EC[i]*fc))
    #Relative slenderness ratio
    lambdarel.append(1/m.sqrt(kE[i]))
    #kfire coefficient
    kfire.append(0.5*(1+Bc*(lambdarel[i]-0.5)+lambdarel[i]**2))
    #Critical buckling factor
    if lambdarel<0.5:
        kc.append(1.0)
    else:
        kc.append(1/(kfire[i]+m.sqrt(kfire[i]**2-lambdarel[i]**2)))
    #Characteristic resistance of wood
    NRcfire.append(kc[i]*(EC[i]*fc)*Ar[i])
    print(NRcfire)
# ---------- end python_15 ----------

python_16 = PythonScript(
    ls=critical_column_length,
    W=python_13.Width,
    H=python_13.Height,
    Ar=python_14.Ar,
    Iy=iy_10,
    Iz=iz_8,
    E=e_modulus_e0_2,
    EF=kmod_fire_2.Flexural,
    EC=kmod_fire_2.Compression,
    fc=fc_2,
    Bc=bc_2)  # -> out, a; inputs W: list, H: list, Ar: list, Iy: list, Iz: list, EF: list, EC: list; same code as python_15

# ==== cluster BeregningAfInertimomentExpression
centerline_for_column = ClusterInput()  # Input center line for column
strength_class_wood = ClusterInput()  # Strength class of wood for column
line = Line(centerline_for_column)
support_conditions = ClusterInput()  # Insert support conditions
load = ClusterInput()  # Critical vertical load
line_2 = Line(line)
len = Length(Curve=line_2)
num = Number(support_conditions)
num_2 = Number(strength_class_wood)
num_3 = Number(load)
multiplication = Multiplication(A=num, B=len)
expression = Expression(Ncr=num_3, E=num_2, ls=multiplication, Expression="(ls^2*Ncr)/(Pi^2*E)")
num_4 = Number(expression)
momen_of_inertia = ClusterOutput(num_4)  # Moment of inertia needed to take the given load

# ==== cluster BeregningAfInertimomentMedKomponenter
num = ClusterInput()
num_2 = ClusterInput()
line = ClusterInput()
num_3 = ClusterInput()
num_4 = Number(num)
num_5 = Number(num_2)
line_2 = Line(line)
num_6 = Number(num_3)
pi = Pi(Factor=1)
len = Length(Curve=line_2)
sqr = Square(Value=pi)
multiplication = Multiplication(A=num_6, B=len)
multiplication_2 = Multiplication(A=num_5, B=sqr)
sqr_2 = Square(Value=multiplication)
multiplication_3 = Multiplication(A=num_4, B=sqr_2)
division = Division(A=multiplication_3, B=multiplication_2)
num_7 = Number(division)
num_8 = ClusterOutput(num_7)

# ==== cluster Cluster
required_moment_of_inertia = ClusterInput()
iy = ClusterInput()
iz = ClusterInput()
required_moment_of_inertia_2 = Data(required_moment_of_inertia)
iy_2 = Data(iy)
iz_2 = Data(iz)
area = ClusterInput()
num = Number(required_moment_of_inertia_2)
num_2 = Number(iy_2)
num_3 = Number(iz_2)
python = PythonScript(I=num, Iy=num_2, Iz=num_3)  # -> out, PatternY, PatternZ; inputs Iy: list, Iz: list
# ---------- python: Python ----------
PatternY=[]
PatternZ=[]
#Creating boolean statement for capacity > needed
for i in Iy:
    PatternY.append(i>I)
#print(PatternY)
for i in Iz:
    PatternZ.append(i>I)
# ---------- end python ----------
area_2 = Data(area)
python_2 = PythonScript(x=python.PatternY, y=python.PatternZ)  # -> out, True, False; inputs x: list, y: list
# ---------- python_2: Python ----------
""" Combines two equal length lists of boolean statements
    to one, either dominated by true or false values
"""
T = []
F = []
for i in x:
    if i == 'True':
        T.append('True')
        F.append('True')
    else:
        T.append('False')
        F.append('False')

for i in range(len(y)):
    if y[i] == 'True':
        T[i]= 'True'

for i in range(len(y)):
    if y[i] == 'False':
        F[i]= 'False'

True=T
False=F
# ---------- end python_2 ----------
num_4 = Number(area_2)
cull = CullPattern(List=num_4, CullPattern=python_2.True)
bnd = Bounds(Numbers=cull)
num_5 = Number(num_4)
height_catalog = ClusterInput()
width_catalog = ClusterInput()
dedomain = DeconstructDomain(Domain=bnd)  # -> Start, End
mindex = MemberIndex(Set=num_5, Member=dedomain.Start)  # -> Index, Count
height_catalog_2 = Data(height_catalog)
width_catalog_2 = Data(width_catalog)
bnd_2 = Bounds(Numbers=mindex.Index)
num_6 = Number(width_catalog_2)
dedomain_2 = DeconstructDomain(Domain=bnd_2)  # -> Start, End
num_7 = Number(height_catalog_2)
num_8 = Number(num_5)
item = ListItem(List=num_8, Index=dedomain_2.Start, Wrap=True)
item_2 = ListItem(List=num_7, Index=dedomain_2.Start, Wrap=True)
item_3 = ListItem(List=num_6, Index=dedomain_2.Start, Wrap=True)
width = Data(item_3)
height = Data(item_2)
height_2 = Data(height)
width_2 = Data(width)
height_3 = ClusterOutput(height_2)
width_3 = ClusterOutput(width_2)
