# Grasshopper definition WoodColumnCrossSection.gh (Grasshopper 0.9.76)
# plug-ins: Python Interpreter

width_mm = Panel("""50
38
50
50
75
50
50
63
50
50
100
50
75
75
75
125
75
100
150
100
175
200""")
data = Data(width_mm)
height_mm = Panel("""50
73
75
100
75
125
150
125
175
200
100
225
150
175
200
125
225
200
150
225
175
200""")
wy_10_3_mm_3 = Panel("""20.8
33.8
46.9
83.3
70.3
130
187.5
164
255
333
166.5
422
281
383
500
326
633
667
563
844
893
1335""")
panel = Panel("Savskåret træ")
wz_10_3_mm_3 = Panel("""20.8
17.57
31.3
41.7
70.3
52.1
62.5
82.7
72.9
83.3
166.5
93.8
140.5
164
187.5
326
211
333
563
375
893
1335""")
iy_10_6_mm_4 = Panel("""0.521
1.232
1.760
4.17
2.64
8.14
14.05
10.25
22.3
33.3
8.33
47.5
21.1
33.5
50
20.3
71.2
66.7
42.2
94.9
78.2
133.5""")
iz_10_6_mm_4 = Panel("""0.521
0.334
0.781
1.04
2.64
1.3
1.56
2.6
1.825
2.08
8.33
2.34
5.27
6.15
7.03
20.3
7.91
16.65
42.2
18.75
78.2
133.5""")

# ---- group: Support conditions column
list = ValueList({"Simply supported both ends": 1, "One end fixed and one end not supported": 2, "One end fixed and one end simply supported": 0.699, "Both ends fixed": 1/2}, selected="One end fixed and one end not supported")

# ---- group: Strength class wood
strength_class_for_wood = ValueList({"C30": 30, "C24": 24, "C18": 18, "C14": 14, "GL32": 32, "Gl28": 28, "GL24": 24}, selected="C14")

# ----
# "Calculation of minimum required cross section of wooden columns"
# 
# "2017"
# 
# Created by Mikkel Dohm Andersen
load_in_n = Slider(1000, range=0..1000)
data_2 = Data(height_mm)
pt = ConstructPoint(XCoordinate=0, YCoordinate=0, ZCoordinate=0)
pt_2 = ConstructPoint(XCoordinate=0, YCoordinate=0, ZCoordinate=Slider(3000, range=0..10000))
data_3 = Data(wy_10_3_mm_3)
ln = Line(StartPoint=pt, EndPoint=pt_2)
data_4 = Data(wz_10_3_mm_3)

# ---- group: Calculate required moment of inertia python
calculate_required_moment_of_inertia = PythonScript(Ncr=load_in_n, E=strength_class_for_wood, SupCon=list, CL=ln)  # -> out, I
# ---------- calculate_required_moment_of_inertia: Python ----------
import math as m
import rhinoscriptsyntax as rs

ls = rs.CurveLength(CL)*SupCon
I = (m.pow(ls,2)*Ncr)/(m.pow(m.pi,2)*E)
print(I)
# ---------- end calculate_required_moment_of_inertia ----------

# ---- group: Calculate required moment of inertia expression
beregning_af_inertimoment_expression = BeregningAfInertimomentExpression(load=load_in_n, strength_class_wood=strength_class_for_wood, support_conditions=list, centerline_for_column=ln)  # disabled

# ----
data_5 = Data(iy_10_6_mm_4)
panel_2 = Panel(calculate_required_moment_of_inertia.I)

# ---- group: Calculate required moment of inertia components
beregning_af_inertimoment_med_komponente = BeregningAfInertimomentMedKomponenter()  # "Beregning af inertimoment med komponenter"; disabled

# ----
data_6 = Data(iz_10_6_mm_4)
entwine = Entwine(Branch00=data, Branch01=data_2, Branch02=data_3, Branch03=data_4, Branch04=data_5, Branch05=data_6, FlattenInputs=True)
data_7 = Data(entwine)
data_8 = Data(Tree({0;0}: ["""50
38
50
50
75
50
50
63
50
50
100
50
75
75
75
125
75
100
150
100
175
200"""], {0;1}: ["""50
73
75
100
75
125
150
125
175
200
100
225
150
175
200
125
225
200
150
225
175
200"""], {0;2}: ["""20.8
33.8
46.9
83.3
70.3
130
187.5
164
255
333
166.5
422
281
383
500
326
633
667
563
844
893
1335"""], {0;3}: ["""20.8
17.57
31.3
41.7
70.3
52.1
62.5
82.7
72.9
83.3
166.5
93.8
140.5
164
187.5
326
211
333
563
375
893
1335"""], {0;4}: ["""0.521
1.232
1.760
4.17
2.64
8.14
14.05
10.25
22.3
33.3
8.33
47.5
21.1
33.5
50
20.3
71.2
66.7
42.2
94.9
78.2
133.5"""], {0;5}: ["""0.521
0.334
0.781
1.04
2.64
1.3
1.56
2.6
1.825
2.08
8.33
2.34
5.27
6.15
7.03
20.3
7.91
16.65
42.2
18.75
78.2
133.5"""]))
livestock_heat_transmission = Livestock_Heat_Transmission()  # -> out, Q, Qi; inputs Geo: list, U: list
# ---------- livestock_heat_transmission: Python ----------
"""
Livestock Heat transfer - Transmission. Calculates the transmission losses and gains of various geometries under stationary conditions
-----
Please notice only type of geometry type is allowed as input 
-----
LIVESTOCK made by Kristoffer Negendahl, DTU.BYG

    Args:
        Geo: List of Surfaces, Breps or Meshes
        U: List of U-values [W/(m2K)] for each Geometry (if only one U, all Geometries will be evaluated on the single U-value)
        Ti: Temperature (C) on the inner side of the geometry (20C is set as default)
        To: Temperature (C) on the outside of the geometry (-12C is set as default)
    Returns:
        Q: Output the transmission heat balance [kW] - if negative the transmission is considered as a loss from inside to the outside, and if positive the transmission is a gain from outside to the inside
        Qi: Output the individual geometry transmission heat balance [W]
"""

# Add the message thingie underneath the component
ghenv.Component.Name = 'Livestock_Heat_Transmission'
ghenv.Component.NickName = 'Livestock Heat Transmission'
ghenv.Component.Message = 'Transmission v.0.1'

# Importing classes and modules
import Rhino as rc

# Setting defaults 

U_def = [0]
Ti_def = 20
To_def = -12

### Ordering inputs into dedicated lists
## Supports three types of geometry 
srfs = []
breps = []
meshes = []

for g in Geo:
    #print type(g)
    if isinstance(g,rc.Geometry.Surface): #is surface
        #print("a surface")
        srfs.append(g)
    elif isinstance(g,rc.Geometry.Brep): #is Brep
        #print("a brep")
        breps.append(g)
    elif isinstance(g,rc.Geometry.Mesh): #is Mesh
        #print("a mesh")
        meshes.append(g)
    else:
        print("not a geometry I can work with")

# Output relevant information
noSrfs = str(len(srfs))
noBreps = str(len(breps))
noMeshes = str(len(meshes))

print "Transmission from {} surfaces,".format(noSrfs), "{} breps,".format(noBreps), "{} meshes".format(noMeshes)

# Function that calucalates an area of a geometry
def area(list_of_geometry):
    area = []
    areaerror = []
    #try: # -- can't use this - only works on breps and srfs
        #for i in range(len(list_of_geometry)):
            #area.append(list_of_geometry[i].GetArea())
    #except:
        #print "Geometry had no GetArea properties"
    try:
        for i in range(len(list_of_geometry)):
            area.append(rc.Geometry.AreaMassProperties.Compute(list_of_geometry[i]).Area)
            areaerror.append(rc.Geometry.AreaMassProperties.Compute(list_of_geometry[i]).AreaError)
    except:
        print "Geometry had no AreaMassProperties properties"
    #print(areaerror)
    return area

# Function that calculates the transmission balance
def transm(areas, Uvals, ti, to):
    qli = []
    if len(areas) > 1 and len(areas) == len(Uvals): #when multiple Uvals
        for i in range(len(areas)):
            qli.append(areas[i]*Uvals[i]*(to-ti))
    else: #when only one Uval
        for i in range(len(areas)):
            qli.append(areas[i]*Uvals[0]*(to-ti))
    Qi = qli
    Q = round(sum(qli)/1000,2)
    return Q, Qi

# Setting defaults if nothing else is assigned 
if not U:
    U = U_def
if not Ti:
    Ti = Ti_def
if not To:
    To = To_def


# Check geometry lists and assign area function

if srfs:
    try: A = area(srfs)
    except: print("not a geometry I can work with")
elif breps:
    try: A = area(breps)
    except: print("not a geometry I can work with")
elif meshes:
    try: A = area(meshes)
    except: print("not a geometry I can work with")

# Calculate heat transmission

Transmission = transm(A, U, Ti, To)
Q = Transmission[0]
Qi = Transmission[1]
# ---------- end livestock_heat_transmission ----------
python = PythonScript()  # -> out, a
# ---------- python: Python ----------
""" Returns dimensions for the smallest cross section with a capacity larger than needed

    Args:
        I: Moment of inertia needed
        W: Width of profile
        H: Height of profile
# ---------- end python ----------
panel_3 = Panel(data_8)

# ==== cluster BeregningAfInertimomentExpression
centerline_for_column = ClusterInput()  # Input center line for column
strength_class_wood = ClusterInput()  # Strength class of wood for column
line = Line(centerline_for_column)
support_conditions = ClusterInput()  # Insert support conditions
load = ClusterInput()  # Critical vertical load
line_2 = Line(line)
len = Length(Curve=line_2)
num = Number(support_conditions)
num_2 = Number(strength_class_wood)
num_3 = Number(load)
multiplication = Multiplication(A=num, B=len)
expression = Expression(Ncr=num_3, E=num_2, ls=multiplication, Expression="(ls^2*Ncr)/(Pi^2*E)")
num_4 = Number(expression)
momen_of_inertia = ClusterOutput(num_4)  # Moment of inertia needed to take the given load

# ==== cluster BeregningAfInertimomentMedKomponenter
num = ClusterInput()
num_2 = ClusterInput()
line = ClusterInput()
num_3 = ClusterInput()
num_4 = Number(num)
num_5 = Number(num_2)
line_2 = Line(line)
num_6 = Number(num_3)
pi = Pi(Factor=1)
len = Length(Curve=line_2)
sqr = Square(Value=pi)
multiplication = Multiplication(A=num_6, B=len)
multiplication_2 = Multiplication(A=num_5, B=sqr)
sqr_2 = Square(Value=multiplication)
multiplication_3 = Multiplication(A=num_4, B=sqr_2)
division = Division(A=multiplication_3, B=multiplication_2)
num_7 = Number(division)
num_8 = ClusterOutput(num_7)
